vi "Generate Output (1D DBL).gvi"   [LabVIEW NXG 1.0.0]
panel controls:
  "AO Channel": "Physical Channel" = "cDAQ1Mod4/ao0"
  "Amplitude": f64 = 1
  "Frequency (Hz)": f64 = 10
  "Phase In": f64
  "Offset": f64
  "AO Sample Rate (Hz)": f64 = 4400
  "Number of Samples": i32 = 1000
uses:
  NI::Analysis::Generation::Sine Wave.gvi
  NI::G Core::Error::Display Error.gvi
diagram:
  call "Sine Wave.gvi"(samples=$"Number of Samples", amplitude=$Amplitude, frequency=$"Frequency (Hz)", phase in=$"Phase In", sample rate=$"AO Sample Rate (Hz)", offset=$Offset) -> (sine wave=w1)
  call "DAQmx Create Channel (AO-Voltage-Basic).gvi"(physical channels=$"AO Channel") -> (error out=w2, task out=w3)
  call "DAQmx Timing (Sample Clock).gvi"(error in=w2, task in=w3, rate=$"AO Sample Rate (Hz)", sample mode="Finite Samples"(10178), samples per channel=$"Number of Samples") -> (error out=w4, task out=w5)
  call "DAQmx Write (Analog Wfm 1Chan NSamp).gvi"(error in=w4, task in=w5, data=w1) -> (error out=w6, task out=w7)
  call "DAQmx Start Task.gvi"(error in=w6, task in=w7) -> (error out=w8, task out=w9)
  call "DAQmx Wait Until Done.gvi"(error in=w8, task in=w9) -> (error out=w10, task out=w11)
  call "DAQmx Clear Task.gvi"(error in=w10, task in=w11) -> (error out=w12)
  call "Display Error.gvi"(error in=w12)
