vi "Generate Output (Waveform).gvi"   [LabVIEW NXG 1.0.0]
panel controls:
  "AO Channel": "Physical Channel" = "cDAQ1Mod4/ao0"
  "Amplitude": f64 = 0.01
  "Frequency (Hz)": f64 = 440
  "Phase In": f64
  "Offset": f64
  "AO Sample Rate (Hz)": f64 = 4400
  "Number of Samples": i32 = 440
uses:
  NI::Analysis::Generation::Sine Waveform.gvi
  NI::G Core::Error::Display Error.gvi
diagram:
  call "Sine Waveform.gvi"(amplitude=$Amplitude, frequency=$"Frequency (Hz)", phase in=$"Phase In", sample rate=$"AO Sample Rate (Hz)", samples=$"Number of Samples", offset=$Offset) -> (sine wave=w1)
  call "DAQmx Create Channel (AO-Voltage-Basic).gvi"(physical channels=$"AO Channel") -> (error out=w2, task out=w3)
  call "DAQmx Timing (Use Waveform).gvi"(error in=w2, task in=w3, waveform=w1, sample mode="Finite Samples"(10178)) -> (error out=w4, task out=w5)
  call "DAQmx Write (Analog Wfm 1Chan NSamp).gvi"(error in=w4, task in=w5, data=w1) -> (error out=w6, task out=w7)
  call "DAQmx Start Task.gvi"(error in=w6, task in=w7) -> (error out=w8, task out=w9)
  call "DAQmx Wait Until Done.gvi"(error in=w8, task in=w9) -> (error out=w10, task out=w11)
  call "DAQmx Clear Task.gvi"(error in=w10, task in=w11) -> (error out=w12)
  call "Display Error.gvi"(error in=w12)
