vi "Programmatically Create 2D Array.gvi"   [LabVIEW NXG 1.0.0]
panel indicators:
  "2D DBL Array": f64[][]
diagram:
  w1 = 4  # Rows
  for (N = w1) (iteration -> i1) {
    w3 = 6  # Columns
    for (N = w3) {
      Random Number() -> (number (0 to 1)=w5)
      append w5 to w4
    }
    Add(w4, i1) -> w6
    append w6 to w2
  }
  $"2D DBL Array" <- w2
