vi "Stimulus-Response (Scalar).gvi"   [LabVIEW NXG 1.0.0]
panel controls:
  "AO Voltage Channel": "Physical Channel" = "cDAQ1Mod4/ao1"
  "Stimulus Values (V)": f64[] = [1, 2, 3, 3.25, 3.5, 3.75, 4]
  "Settling time (ms)": u32 = 500
  "AI Voltage Channel": "Physical Channel" = "cDAQ1Mod7/ai0"
panel indicators:
  "Current Stimulus (V)": f64
  "Current Response (V)": f64
  "All Responses": f64[]
uses:
  NI::G Core::Error::Display Error.gvi
diagram:
  call "DAQmx Create Channel (AO-Voltage-Basic).gvi"(physical channels=$"AO Voltage Channel") -> (error out=w1, task out=w2)
  w3 = 0  # Initial Stimulus (V)
  # DAQmx
  # Write
  call "DAQmx Write (Analog DBL 1Chan 1Samp).gvi"(error in=w1, task in=w2, data=w3) -> (error out=w4, task out=w5)
  call "DAQmx Start Task.gvi"(error in=w4, task in=w5) -> (error out=w6, task out=w7)
  call "DAQmx Create Channel (AI-Voltage-Basic).gvi"(error in=w6, physical channels=$"AI Voltage Channel") -> (error out=w8, task out=w9)
  call "DAQmx Start Task.gvi"(error in=w8, task in=w9) -> (error out=w10, task out=w11)
  w12 = $"Settling time (ms)"
  s1 = w7  # shift register
  s2 = w10  # shift register
  s3 = w11  # shift register
  for {
    w13 = each element of $"Stimulus Values (V)"
    $"Current Stimulus (V)" <- w13
    # DAQmx Write
    call "DAQmx Write (Analog DBL 1Chan 1Samp).gvi"(error in=s2, task in=s1, data=w13) -> (error out=w15, task out=w16)
    sequence {
      frame 0 {
        # Wait
        Wait(time to wait=w12)
      }
    }
    # DAQmx Read
    call "DAQmx Read (Analog DBL 1Chan 1Samp).gvi"(error in=w15, task in=s3) -> (error out=w17, task out=w18, data=w19)
    $"Current Response (V)" <- w19
    append w19 to w14
    next s1 = w16
    next s2 = w17
    next s3 = w18
    stop if w17
  }
  w20 = 0  # Shutdown Stimulus (V)
  # DAQmx
  # Write
  call "DAQmx Write (Analog DBL 1Chan 1Samp).gvi"(error in=s2, task in=s1, data=w20) -> (error out=w21, task out=w22)
  call "DAQmx Clear Task.gvi"(error in=w21, task in=w22) -> (error out=w23)
  call "DAQmx Clear Task.gvi"(error in=w23, task in=s3) -> (error out=w24)
  call "Display Error.gvi"(error in=w24)
  $"All Responses" <- w14
