vi "Stimulus-Response (Waveform).gvi"   [LabVIEW NXG 1.0.0]
panel controls:
  "AO Voltage Channel": "Physical Channel" = "cDAQ1Mod4/ao1"
  "Stimulus Values (V)": f64[] = [1, 2, 3, 3.25, 3.5, 3.75, 4]
  "Settling time (ms)": u32 = 500
  "AI Voltage Channel": "Physical Channel" = "cDAQ1Mod7/ai0"
  "Sample Rate (Hz)": f64 = 1000
  "Number of Samples": i32 = 1000
panel indicators:
  "Current Stimulus (V)": f64
  "Current Response": f64[]
  "All Responses": f64[][]
uses:
  NI::G Core::Error::Display Error.gvi
diagram:
  w1 = $"Number of Samples"
  call "DAQmx Create Channel (AI-Voltage-Basic).gvi"(physical channels=$"AI Voltage Channel") -> (error out=w2, task out=w3)
  call "DAQmx Timing (Sample Clock).gvi"(error in=w2, task in=w3, rate=$"Sample Rate (Hz)", sample mode="Finite Samples"(10178), samples per channel=w1) -> (error out=w4, task out=w5)
  call "DAQmx Create Channel (AO-Voltage-Basic).gvi"(error in=w4, physical channels=$"AO Voltage Channel") -> (error out=w6, task out=w7)
  w8 = 0  # Initial Stimulus (V)
  call "DAQmx Write (Analog DBL 1Chan 1Samp).gvi"(error in=w6, task in=w7, data=w8) -> (error out=w9, task out=w10)
  call "DAQmx Start Task.gvi"(error in=w9, task in=w10) -> (error out=w11, task out=w12)
  w13 = $"Settling time (ms)"
  s1 = w12  # shift register
  s2 = w11  # shift register
  s3 = w5  # shift register
  for {
    w14 = each element of $"Stimulus Values (V)"
    $"Current Stimulus (V)" <- w14
    call "DAQmx Write (Analog DBL 1Chan 1Samp).gvi"(error in=s2, task in=s1, data=w14) -> (error out=w16, task out=w17)
    sequence {
      frame 0 {
        Wait(time to wait=w13)
      }
    }
    call "DAQmx Start Task.gvi"(error in=w16, task in=s3) -> (error out=w18, task out=w19)
    call "DAQmx Read (Analog 1D DBL 1Chan NSamp).gvi"(error in=w18, task in=w19, number of samples per channel=w1) -> (error out=w20, task out=w21, data=w22)
    call "DAQmx Stop Task.gvi"(error in=w20, task in=w21) -> (error out=w23, task out=w24)
    $"Current Response" <- w22
    append w22 to w15
    next s1 = w17
    next s2 = w23
    next s3 = w24
    stop if w23
  }
  w25 = 0  # Shutdown Stimulus (V)
  call "DAQmx Write (Analog DBL 1Chan 1Samp).gvi"(error in=s2, task in=s1, data=w25) -> (error out=w26, task out=w27)
  call "DAQmx Clear Task.gvi"(error in=w26, task in=w27) -> (error out=w28)
  call "DAQmx Clear Task.gvi"(error in=w28, task in=s3) -> (error out=w29)
  call "Display Error.gvi"(error in=w29)
  $"All Responses" <- w15
