vi "Voltage Ramp.gvi"   [LabVIEW NXG 1.0.0]
panel controls:
  "Start": f64
  "End": f64 = 5
  "Number of Samples": i32 = 11
  "AO Voltage Channel": "Physical Channel" = "cDAQ1Mod4/ao1"
  "Duration per Sample (ms)": u32 = 1000
panel indicators:
  "Ramp Pattern (V)": f64[]
  "Current AO Output (V)": f64
uses:
  NI::Analysis::Generation::Ramp Pattern by Samples.gvi
  NI::G Core::Error::Display Error.gvi
diagram:
  call "Ramp Pattern by Samples.gvi"(samples=$"Number of Samples", end=$End, start=$Start) -> (ramp pattern=w1)
  $"Ramp Pattern (V)" <- w1
  w2 = $"Duration per Sample (ms)"
  # DAQmx
  # Create Channel
  # (AO-Voltage)
  call "DAQmx Create Channel (AO-Voltage-Basic).gvi"(physical channels=$"AO Voltage Channel") -> (error out=w3, task out=w4)
  w5 = 0  # Initial Voltage
  # DAQmx
  # Write
  call "DAQmx Write (Analog DBL 1Chan 1Samp).gvi"(error in=w3, task in=w4, data=w5) -> (error out=w6, task out=w7)
  call "DAQmx Start Task.gvi"(error in=w6, task in=w7) -> (error out=w8, task out=w9)
  s1 = w9  # shift register
  s2 = w8  # shift register
  for {
    w10 = each element of w1
    Wait(time to wait=w2)  # Wait (Milliseconds)
    $"Current AO Output (V)" <- w10
    # DAQmx
    # Write
    call "DAQmx Write (Analog DBL 1Chan 1Samp).gvi"(error in=s2, task in=s1, data=w10) -> (error out=w11, task out=w12)
    next s1 = w12
    next s2 = w11
  }
  w13 = 0  # Shutdown Voltage
  # DAQmx
  # Write
  call "DAQmx Write (Analog DBL 1Chan 1Samp).gvi"(error in=s2, task in=s1, data=w13) -> (error out=w14, task out=w15)
  call "DAQmx Clear Task.gvi"(error in=w14, task in=w15) -> (error out=w16)
  call "Display Error.gvi"(error in=w16)
