vi "Main.gvi"   [LabVIEW NXG 1.0.0]
panel controls:
  "Stop": bool  # Stop stops the acquisition. It is recommended to stop your VI through this stop button so the DAQmx task can be properly cleared.
  "Upper Limit": f64 = 30
  "Lower Limit": f64 = 20
  "Thermocouple Channel": "Physical Channel" = "cDAQ1Mod2/ai0"
panel indicators:
  "Waveform Chart": f64  # Waveform Graph displays the most recent acquired data.
  "Weather Data": T1
types:
  T1 = cluster{"Current Temperature": f64, "Max Temperature": f64, "Min Temperature": f64, "Warning?": bool, "Warning Text": string}
  T2 = cluster{"maximum value": f64, "minimum value": f64}
uses:
  NI::G Core::Error::Display Error.gvi
diagram:
  Get Component Directory() -> (Path=w1)
  Build Path(base path=w1, name or relative path="Temperature Warnings.txt") -> (appended path=w2)
  Open Or Create Or Replace File(file path (use dialog)=w2, operation (0:open)="open or create") -> (error out=w3, refnum out=w4)
  w5 = 1  # Desired Sample Rate (Hz)
  call "DAQmx Create Channel (AI-Temperature-Thermocouple).gvi"(error in=w3, physical channels=$"Thermocouple Channel", units="Deg C"(10143), measurement range=T2 {"maximum value"=100, "minimum value"=0}, thermocouple type="J"(10072)) -> (error out=w6, task out=w7)
  call "DAQmx Timing (Sample Clock).gvi"(error in=w6, task in=w7, rate=w5, sample mode="Continuous Samples"(10123)) -> (error out=w8, task out=w9)
  call "DAQmx Start Task.gvi"(error in=w8, task in=w9) -> (error out=w10, task out=w11)
  s1 = w4  # shift register
  s2 = w10  # shift register
  while {
    call "DAQmx Read (Analog DBL 1Chan 1Samp).gvi"(error in=s2, task in=w11) -> (error out=w12, task out=w13, data=w14)
    Property Node(instance in=T1 {all zero or empty}, "Max Temperature"=$"Upper Limit", "Min Temperature"=$"Lower Limit", "Current Temperature"=w14) -> (instance out=w15)
    call "Determine Warnings.gvi"(Weather Data In=w15, Error In=w12) -> (Weather Data Out=w16, Error Out=w17)
    $"Weather Data" <- w16
    $"Waveform Chart" <- w14
    Property Node(instance in=w16) -> ("Warning?"=w18)
    case (w18) {
      frame False, Default {
        w19 = w17
        w20 = s1
      }
      frame True {
        call "Log Warnings.gvi"(Weather Data=w16, file ref in=s1, error in=w17) -> (file ref out=w20, error out=w19)
      }
    }
    Logical Or(w19, $Stop) -> w21
    next s1 = w20
    next s2 = w19
    stop if w21
  }
  call "DAQmx Stop Task.gvi"(error in=s2, task in=w13) -> (error out=w22, task out=w23)
  call "DAQmx Clear Task.gvi"(error in=w22, task in=w23) -> (error out=w24)
  Close File(error in=w24, refnum=s1) -> (error out=w25)
  call "Display Error.gvi"(error in=w25)
