vi "Determine Warnings.gvi"   [LabVIEW NXG 1.0.0]
# In this exercise, you put the inputs and outputs into a cluster.
inputs:
  "Error In": error
outputs:
  "Error Out": error
panel controls:
  "Current Temperature": f64
  "Max Temperature": f64
  "Min Temperature": f64
panel indicators:
  "Warning?": bool
  "Warning Text": string
diagram:
  # If Current Temperature <= Min Temperature, output a Freeze Warning.
  Is Less Or Equal(x=$"Current Temperature", y=$"Min Temperature") -> w1
  Is Greater Or Equal(x=$"Current Temperature", y=$"Max Temperature") -> w2
  # If Current Temperature >= Max Temperature, output a Heatstroke Warning.
  Select(s=w2, t="Heatstroke Warning", f="No Warning") -> w3
  Select(s=w1, t="Freeze Warning", f=w3) -> w4
  Is Not Equal(x="No Warning", y=w4) -> w5
  $"Warning?" <- w5
  $"Warning Text" <- w4
  $"Error Out" <- $"Error In"
