vi "Main.gvi"   [LabVIEW NXG 1.0.0]
panel controls:
  "Thermocouple Channel": "Physical Channel" = "cDAQ1Mod2/ai0"
  "Stop": bool
  "Measurement Range (deg C)": T1 = {"maximum value"=100, "minimum value"=0}
panel indicators:
  "Waveform Chart": f64
types:
  T1 = cluster{"maximum value": f64, "minimum value": f64}
uses:
  NI::G Core::Error::Display Error.gvi
diagram:
  Open Or Create Or Replace File(operation (0:open)="replace or create") -> (error out=w1, refnum out=w2)  # Open/Create/Replace File
  w3 = "\r\n"  # End of Line Constant
  Concatenate Strings("Temperature (deg C)", w3) -> w4
  Write To Text File(error in=w1, file (use dialog)=w2, text=w4) -> (error out=w5, refnum out=w6)
  w7 = 1  # sample rate (Hz)
  call "DAQmx Create Channel (AI-Temperature-Thermocouple).gvi"(error in=w5, physical channels=$"Thermocouple Channel", measurement range=$"Measurement Range (deg C)") -> (error out=w8, task out=w9)
  call "DAQmx Timing (Sample Clock).gvi"(error in=w8, task in=w9, rate=w7, sample mode="Continuous Samples"(10123)) -> (error out=w10, task out=w11)
  call "DAQmx Start Task.gvi"(error in=w10, task in=w11) -> (error out=w12, task out=w13)
  while {
    call "DAQmx Read (Analog DBL 1Chan 1Samp).gvi"(error in=w12, task in=w13) -> (error out=w14, task out=w15, data=w16)
    $"Waveform Chart" <- w16
    w17 = "%.3f%s"  # format string
    w18 = "\r\n"  # End of Line Constant
    Format Into String(formatString=w17, errIn=w14, w16, w18) -> (outString=w19, errOut=w20)
    Write To Text File(error in=w20, file (use dialog)=w6, text=w19) -> (error out=w21, refnum out=w22)
    Logical Or(w21, $Stop) -> w23
    stop if w23
  }
  call "DAQmx Stop Task.gvi"(error in=w21, task in=w15) -> (error out=w24, task out=w25)
  call "DAQmx Clear Task.gvi"(error in=w24, task in=w25) -> (error out=w26)
  Close File(error in=w26, refnum=w22) -> (error out=w27)
  call "Display Error.gvi"(error in=w27)
