vi "Generate Timestamped Filepath.gvi"   [LabVIEW NXG 1.0.0]
panel controls:
  "appended filename": string
panel indicators:
  "timestamped relative filepath": path
diagram:
  Concatenate Strings("%Y%m%d_%H%M%S_", $"appended filename", ".txt") -> w1
  Get Current Time() -> (current time=w2)
  Format Date Time String(time format string (%c)=w1, time stamp=w2) -> (date/time string=w3)  # Format Date and Time String
  Get Component Directory() -> (Path=w4)
  Build Path(base path=w4, name or relative path=w3) -> (appended path=w5)
  $"timestamped relative filepath" <- w5
