vi "Analyze Temperature (incorrect behavior).gvi"   [LabVIEW NXG 1.0.0]
panel controls:
  "Upper Limit (deg F)": f64 = 90
  "Lower Limit (deg F)": f64 = 32
panel indicators:
  "Current Temperature (deg F)": f64
  "In Range?": bool
  "Current Temperature (deg C)": f64
diagram:
  w1 = "cDAQ1Mod2/ai0"  # Thermocouple Channel
  # Set this constant to your thermocouple channel
  call "DAQmx Create Channel (AI-Temperature-Thermocouple).gvi"(physical channels=w1) -> (task out=w2)
  call "DAQmx Start Task.gvi"(task in=w2) -> (task out=w3)
  call "DAQmx Read (Analog DBL 1Chan 1Samp).gvi"(task in=w3) -> (task out=w4, data=w5)
  call "DAQmx Clear Task.gvi"(task in=w4)
  $"Current Temperature (deg C)" <- w5
  # (deg F) = (deg C) * 9/5 + 32
  Multiply(w5, 5) -> w6
  Divide(x=w6, y=9) -> w7
  Add(w7, 32) -> w8
  $"Current Temperature (deg F)" <- w8
  In Range And Coerce[IncludeHighLimit=True](lower limit=$"Lower Limit (deg F)", upper limit=$"Upper Limit (deg F)", x=w8) -> (In Range?=w9)
  $"In Range?" <- w9
