vi "Automatic Error Management.gvi"   [LabVIEW NXG 1.0.0]
panel indicators:
  "Data": f64
diagram:
  # Error:
  # In this hardware setup, cDAQ1Mod1/ai0 is not a thermocouple channel.
  w1 = "cDAQ1Mod1/ai0"  # thermocouple channel
  call "DAQmx Create Channel (AI-Temperature-Thermocouple).gvi"(physical channels=w1) -> (task out=w2)
  call "DAQmx Start Task.gvi"(task in=w2) -> (task out=w3)
  call "DAQmx Read (Analog DBL 1Chan 1Samp).gvi"(task in=w3) -> (task out=w4, data=w5)
  call "DAQmx Clear Task.gvi"(task in=w4)
  $Data <- w5
