vi "Programmatic Error Management.gvi"   [LabVIEW NXG 1.0.0]
panel indicators:
  "Data": f64
uses:
  NI::G Core::Error::Display Error.gvi
diagram:
  # Error:
  # In this hardware setup, cDAQ1Mod1/ai0 is not a thermocouple channel.
  call "DAQmx Create Channel (AI-Temperature-Thermocouple).gvi"(physical channels="cDAQ1Mod1/ai0") -> (error out=w1, task out=w2)
  call "DAQmx Start Task.gvi"(error in=w1, task in=w2) -> (error out=w3, task out=w4)
  call "DAQmx Read (Analog DBL 1Chan 1Samp).gvi"(error in=w3, task in=w4) -> (error out=w5, task out=w6, data=w7)
  call "DAQmx Clear Task.gvi"(error in=w5, task in=w6) -> (error out=w8)
  call "Display Error.gvi"(error in=w8)
  $Data <- w7
