vi "Read Binary File.gvi"   [LabVIEW NXG 1.0.0]
panel indicators:
  "Data Read from File": f64[]
uses:
  NI::G Core::Error::Display Error.gvi
diagram:
  Open Or Create Or Replace File(file path (use dialog)=path "C:\\Data\\Example Binary File.dat", operation (0:open)="open") -> (error out=w1, refnum out=w2)  # Open/Create/Replace File
  Get File Size(error in=w1, file=w2) -> (error out=w3, refnum out=w4, size (in bytes)=w5)
  # To change binary file formats,
  # change the byte order value.
  # File read/write performance is dependent upon the size of the data written to disk.  This optimum "chunk" size will depend upon your operating system
  # and disk block size.  For example, in Windows, reading or writing in 65,000 byte chunks will often optimize performance.
  Divide(x=w5, y=8) -> w6
  # w7: count
  To Long Integer(number=w6) -> w7
  # The Open/Create/Replace File node will open the file created by Write Binary File.gvi.  The Get File Size node reads the size of the file. Since the
  # data type of the binary data is a DBL array, divide the file size by 8 to determine how many DBL values are stored in the file. This value is specified as
  # the count for the Read from Binary File node. Then, the Close File node closes the file reference.
  w8 = f64 0  # File Data Type (DBL)
  Read From Binary File(byte order="little-endian", count=w7, data type=w8, error in=w3, file (use dialog)=w4) -> (data=w9, error out=w10, refnum out=w11)
  Close File(error in=w10, refnum=w11) -> (error out=w12)
  call "Display Error.gvi"(error in=w12)
  $"Data Read from File" <- w9
