vi "Write Binary File.gvi"   [LabVIEW NXG 1.0.0]
panel indicators:
  "Data Written to File": f64[]
uses:
  NI::Analysis::Generation::Sine Wave.gvi
  NI::G Core::Error::Display Error.gvi
diagram:
  # Generate a 1D DBL array of 100 values representing a sine wave
  # w1: 1D DBL
  call "Sine Wave.gvi"(samples=100) -> (sine wave=w1)
  # The Open/Create/Replace File node will create the new file. The Write to Binary File node writes the data to a file.
  # Data is written in little-endian format. Then, the Close File node closes the file reference.
  $"Data Written to File" <- w1
  Open Or Create Or Replace File(file path (use dialog)=path "C:\\Data\\Example Binary File.dat", operation (0:open)="replace or create") -> (error out=w2, refnum out=w3)  # Open/Create/Replace File
  # To change binary file formats,
  # convert the array of data to another
  # representation and change the byte
  # order value.
  # File read/write performance is dependent upon the size of the data written to disk. This optimum "chunk" size will depend upon your operating system
  # and disk block size. For example, in Windows, reading or writing in 65,000 byte chunks will often optimize performance.
  Write To Binary File(byte order="little-endian", data=w1, error in=w2, file (use dialog)=w3, prepend=FALSE) -> (error out=w4, refnum out=w5)
  Close File(error in=w4, refnum=w5) -> (error out=w6)
  call "Display Error.gvi"(error in=w6)
