vi "Common Mechanical Actions.gvi"   [LabVIEW NXG 1.0.0]
panel controls:
  "Clear Counters": bool
  "Switch When Released": bool
  "Latch When Released": bool
  "Stop": bool
panel indicators:
  "Switch When Released Status": bool
  "Latch When Released Status": bool
  "Switch When Released Counter": u32
  "Latch When Released Counter": u32
  "Tab": i32
diagram:
  s1 = 0  # shift register
  s2 = 0  # shift register
  while {
    $"Switch When Released Status" <- $"Switch When Released"
    Increment(x=s2) -> w1
    Select(s=$"Latch When Released", t=w1, f=s2) -> w2
    Increment(x=s1) -> w3
    Select(s=$"Switch When Released", t=w3, f=s1) -> w4
    case ($"Clear Counters") {
      frame False, Default {
        w5 = w4
        w6 = w2
      }
      frame True {
        w5 = 0
        w6 = 0
      }
    }
    $"Switch When Released Counter" <- w5
    $"Latch When Released Status" <- $"Latch When Released"
    $"Latch When Released Counter" <- w6
    Wait(time to wait=250)
    next s1 = w5
    next s2 = w6
    stop if $Stop
  }
