vi "Other Mechanical Actions.gvi"   [LabVIEW NXG 1.0.0]
panel controls:
  "Clear Counters": bool
  "Switch When Pressed": bool
  "Switch Until Released": bool
  "Latch When Pressed": bool
  "Stop": bool
panel indicators:
  "Switch When Pressed Status": bool
  "Switch Until Released Status": bool
  "Latch When Pressed Status": bool
  "Switch When Pressed Counter": u32
  "Switch Until Released Counter": u32
  "Latch When Pressed Counter": u32
  "Tab": i32
diagram:
  s1 = 0  # shift register
  s2 = 0  # shift register
  s3 = 0  # shift register
  while {
    $"Switch When Pressed Status" <- $"Switch When Pressed"
    Increment(x=s1) -> w1
    Select(s=$"Switch When Pressed", t=w1, f=s1) -> w2
    Increment(x=s2) -> w3
    Select(s=$"Switch Until Released", t=w3, f=s2) -> w4
    Increment(x=s3) -> w5
    Select(s=$"Latch When Pressed", t=w5, f=s3) -> w6
    case ($"Clear Counters") {
      frame False, Default {
        w7 = w2
        w8 = w4
        w9 = w6
      }
      frame True {
        w7 = 0
        w8 = 0
        w9 = 0
      }
    }
    $"Switch When Pressed Counter" <- w7
    $"Switch Until Released Status" <- $"Switch Until Released"
    $"Switch Until Released Counter" <- w8
    $"Latch When Pressed Status" <- $"Latch When Pressed"
    $"Latch When Pressed Counter" <- w9
    Wait(time to wait=250)
    next s1 = w7
    next s2 = w8
    next s3 = w9
    stop if $Stop
  }
