vi "Simple VI.gvi"   [LabVIEW NXG 1.0.0]
panel controls:
  "A": f64
  "B": f64
panel indicators:
  "Sum": f64
  "Difference": f64
diagram:
  Add($A, $B) -> w1
  $Sum <- w1
  Subtract(x=$A, y=$B) -> w2
  $Difference <- w2
