vi "Conditional Logic.gvi"   [LabVIEW NXG 1.0.0]
panel controls:
  "Current Temperature (deg F)": f64
  "Threshold (deg F)": f64 = 100
panel indicators:
  "Message": string
diagram:
  Is Greater(x=$"Current Temperature (deg F)", y=$"Threshold (deg F)") -> w1
  case (w1) {
    frame False, Default {
      w2 = "Normal operation"
    }
    frame True {
      One Button Dialog(message="WARNING! Refer to message for details")
      w2 = "Temperature has exceeded the maximum heat threshold."
    }
  }
  $Message <- w2
