vi "[End of Demo] Data Grid.gvi"   [LabVIEW NXG 1.0.0]
panel controls:
  "stop": bool
panel indicators:
  "Multiple Weather Station Data (Array Indicator)": "Weather Data.gtype"[]
  "Multiple Weather Station Data (Data Grid Indicator)": T1[]
types:
  "Weather Data.gtype" = cluster{"Current Temperature (deg C)": f64, "Max Temperature (deg C)": f64, "Min Temperature (deg C)": f64, "Warning?": bool, "Warning Text": string}
  T1 = cluster{"Current (deg C)": f64, "Max (deg C)": f64, "Min (deg C)": f64, "Warning?": bool, "Warning Text": string}
diagram:
  while {
    Wait Until Next Multiple(multiple to wait=1000)
    call "Acquire Weather Data.gvi"(Initial Current Temperature (°C)=-10) -> (WeatherData=w1)
    call "Acquire Weather Data.gvi"(Initial Current Temperature (°C)=50) -> (WeatherData=w2)
    call "Acquire Weather Data.gvi"(Initial Current Temperature (°C)=0) -> (WeatherData=w3)
    call "Acquire Weather Data.gvi"(Initial Current Temperature (°C)=0) -> (WeatherData=w4)
    call "Acquire Weather Data.gvi"(Initial Current Temperature (°C)=40) -> (WeatherData=w5)
    call "Acquire Weather Data.gvi"(Initial Current Temperature (°C)=40) -> (WeatherData=w6)
    # Simulates acquiring weather data from multiple weather stations
    call "Acquire Weather Data.gvi"(Initial Current Temperature (°C)=25) -> (WeatherData=w7)
    Build Array(w7, w1, w2, w3, w4, w5, w6) -> w8
    $"Multiple Weather Station Data (Array Indicator)" <- w8
    $"Multiple Weather Station Data (Data Grid Indicator)" <- w8
    stop if $stop
  }
