vi "Acquire Weather Data.gvi"   [LabVIEW NXG 1.0.0]
inputs:
  "Initial Current Temperature (°C)": f64
outputs:
  "WeatherData": "Weather Data.gtype"
types:
  "Weather Data.gtype" = cluster{"Current Temperature (deg C)": f64, "Max Temperature (deg C)": f64, "Min Temperature (deg C)": f64, "Warning?": bool, "Warning Text": string}
diagram:
  # This subVI is configured to Stateful VI Reentrancy.
  # You can find this setting by navigating to Configuration pane»Document tab»Properties»Execution.
  #
  # This subVI also uses the Functional Global Variable design pattern to keep store its Weather Data values.
  s1 = uninitialised  # shift register
  while {
    Is First Call() -> w1
    case (w1) {
      frame False, Default {
        Property Node(instance in=s1) -> ("Current Temperature (deg C)"=w3, instance out=w4)
        Random Number() -> (number (0 to 1)=w5)
        Multiply(w5, 2) -> w6
        Subtract(x=w6, y=1) -> w7
        # Add a random value between +/- 1
        Add(w3, w7) -> w8
        Property Node(instance in=w4, "Current Temperature (deg C)"=w8) -> (instance out=w9)
        call "Determine Warnings.gvi"(Weather Data In=w9) -> (Weather Data Out=w2)
      }
      frame True {
        w10 = "Weather Data.gtype" {"Current Temperature (deg C)"=0, "Max Temperature (deg C)"=40, "Min Temperature (deg C)"=0, "Warning?"=FALSE, "Warning Text"=""}
        # When this subVI is called for the first time from a calling VI, set the WeatherData shift register to the inital values below:
        Property Node(instance in=w10, "Current Temperature (deg C)"=$"Initial Current Temperature (°C)", "Max Temperature (deg C)"=40, "Min Temperature (deg C)"=0, "Warning?"=FALSE, "Warning Text"="Normal") -> (instance out=w2)
      }
    }
    next s1 = w2
    stop if TRUE
  }
  $WeatherData <- s1
