vi "Determine Warnings.gvi"   [LabVIEW NXG 1.0.0]
# In this exercise, you put the inputs and outputs into a cluster.
inputs:
  "Weather Data In": "Weather Data.gtype", required
  "Error In": error
outputs:
  "Weather Data Out": "Weather Data.gtype"
  "Error Out": error
types:
  "Weather Data.gtype" = cluster{"Current Temperature (deg C)": f64, "Max Temperature (deg C)": f64, "Min Temperature (deg C)": f64, "Warning?": bool, "Warning Text": string}
diagram:
  Property Node(instance in=$"Weather Data In") -> ("Current Temperature (deg C)"=w1, "Max Temperature (deg C)"=w2, "Min Temperature (deg C)"=w3, instance out=w4)  # Cluster Properties
  # If Current Temperature <= Min Temperature, output a Freeze Warning.
  Is Less Or Equal(x=w1, y=w3) -> w5
  Is Greater Or Equal(x=w1, y=w2) -> w6
  # If Current Temperature >= Max Temperature, output a Heatstroke Warning.
  Select(s=w6, t="Heatstroke Warning", f="No Warning") -> w7
  Select(s=w5, t="Freeze Warning", f=w7) -> w8
  Is Not Equal(x="No Warning", y=w8) -> w9
  Property Node(instance in=w4, "Warning?"=w9, "Warning Text"=w8) -> (instance out=w10)  # Cluster Properties
  $"Weather Data Out" <- w10
  $"Error Out" <- $"Error In"
