vi "[End of Demo] Measurement Panel Task (1Chan1Samp).gvi"   [LabVIEW NXG 1.0.0]
panel indicators:
  "Temperature (deg C)": f64
diagram:
  call "DAQmx Start Task.gvi"(task in="Thermocouple") -> (task out=w1)
  call "DAQmx Read (Analog DBL 1Chan 1Samp).gvi"(task in=w1) -> (task out=w2, data=w3)
  call "DAQmx Clear Task.gvi"(task in=w2)
  $"Temperature (deg C)" <- w3
