vi "[End of Demo] Measurement Panel Task (1ChanNSamp).gvi"   [LabVIEW NXG 1.0.0]
panel controls:
  "number of samples": i32 = 2560
panel indicators:
  "data": waveform<f64>
diagram:
  call "DAQmx Start Task.gvi"(task in="AI Voltage") -> (task out=w1)
  call "DAQmx Read (Analog Wfm 1Chan NSamp).gvi"(task in=w1, number of samples per channel=$"number of samples") -> (task out=w2, data=w3)
  call "DAQmx Clear Task.gvi"(task in=w2)
  $data <- w3
