vi "Main (calling Log Data subVI).gvi"   [LabVIEW NXG 1.0.0]
panel controls:
  "Log Filepath": path
  "Physical Channels": "Physical Channel" = "cDAQ1Mod8/ai0:3"
panel indicators:
  "Graph": f64[][]
  "# of rows logged": i32
  "# of columns logged": i32
uses:
  NI::G Core::Error::Display Error.gvi
diagram:
  w1 = 100  # number of samples
  w2 = 1000  # sample rate (Hz)
  call "DAQmx Create Channel (AI-Voltage-Basic).gvi"(physical channels=$"Physical Channels") -> (error out=w3, task out=w4)
  call "DAQmx Timing (Sample Clock).gvi"(error in=w3, task in=w4, rate=w2, sample mode="Finite Samples"(10178), samples per channel=w1) -> (error out=w5, task out=w6)
  call "DAQmx Start Task.gvi"(error in=w5, task in=w6) -> (error out=w7, task out=w8)
  call "DAQmx Read (Analog 2D DBL NChan NSamp).gvi"(error in=w7, task in=w8) -> (error out=w9, task out=w10, data=w11)
  $Graph <- w11
  call "DAQmx Stop Task.gvi"(error in=w9, task in=w10) -> (error out=w12, task out=w13)
  call "DAQmx Clear Task.gvi"(error in=w12, task in=w13) -> (error out=w14)
  call "[Demo Solution] Log Data.gvi"(log filepath=$"Log Filepath", 2D data=w11, transpose=TRUE, error in=w14) -> (error out=w15, # of rows logged=w16, # of columns logged=w17)
  call "Display Error.gvi"(error in=w15)
  $"# of rows logged" <- w16
  $"# of columns logged" <- w17
