vi "[Demo Solution] Log Data.gvi"   [LabVIEW NXG 1.0.0]
# Logs 2D data to a delimited spreadsheet file.
inputs:
  "log filepath": path, required
  "2D data": f64[][], required
  "transpose": bool
  "error in": error
outputs:
  "error out": error
  "# of rows logged": i32
  "# of columns logged": i32
uses:
  NI::G Core::File IO (General)::Write Delimited Spreadsheet (DBL).gvi
diagram:
  case ($"error in") {
    frame Error, Default {
      w1 = $"error in"
      w2 = 0
      w3 = 0
    }
    frame No Error {
      case ($transpose) {
        frame False, Default {
          w4 = $"2D data"
        }
        frame True {
          Transpose 2D Array(2D array=$"2D data") -> (transposed array=w4)
        }
      }
      Array Size(array=w4) -> (size(s)=w5)
      Array Index(array=w5) -> (out0[_]=w2, out1[_]=w3)
      call "Write Delimited Spreadsheet (DBL).gvi"(file=$"log filepath", 2D data=w4, error in=$"error in") -> (error out=w1)
    }
  }
  $"# of rows logged" <- w2
  $"# of columns logged" <- w3
  $"error out" <- w1
