vi "TDMS Logger.gvi"   [LabVIEW NXG 1.0.0]
panel controls:
  "Operator": string = "<Enter your name here...>"
  "Cutoff Frequency": f64 = 50
panel indicators:
  "Filtered Data": waveform<f64>[]
  "Acquired Data": waveform<f64>[]
uses:
  NI::Analysis::Filtering::Butterworth Lowpass Filter NChan (Waveform).gvi
  NI::G Core::Error::Display Error.gvi
diagram:
  w1 = "Filtered Data"  # group name
  w2 = "Cutoff Frequency"  # property name
  w3 = "Acquired Data"  # group name
  w4 = "Sensor Type"  # property name
  w5 = "Simulated"  # property value
  w6 = "Timestamp"  # property name
  Get Current Time() -> (current time=w7)
  Get Component Directory() -> (Path=w8)
  File Dialog[FileDialogSelectionMode=File, NewOrExistingMode=New](pattern (all files)="*.tdms", pattern label="TDMS File", prompt="Specify TDMS filepath", start path=w8) -> (error out=w9, selected path=w10)
  TDMS Open(error in=w9, file path=w10, operation="create or replace") -> (error out=w11, tdms file out=w12)
  w13 = "Author"  # property name
  TDMS Set Properties(error in=w11, property names=w13, property values=$Operator, tdms file=w12) -> (error out=w14, tdms file out=w15)
  TDMS Set Properties(error in=w14, property names=w6, property values=w7, tdms file=w15) -> (error out=w16, tdms file out=w17)
  call "Simulated Read (1D Waveform).gvi"() -> (data=w18)
  w19 = ["Sensor 0", "Sensor 1", "Sensor 2", "Sensor 3"]  # channel names
  TDMS Write(channel name(s) in=w19, data=w18, error in=w16, group name in=w3, tdms file=w17) -> (error out=w20, tdms file out=w21)
  TDMS Set Properties(error in=w20, group name=w3, property names=w4, property values=w5, tdms file=w21) -> (error out=w22, tdms file out=w23)
  w24 = ["Sensor 0", "Sensor 1", "Sensor 2", "Sensor 3"]  # channel names
  call "Butterworth Lowpass Filter NChan (Waveform).gvi"(signal=w18, cutoff frequency=$"Cutoff Frequency") -> (filtered signal=w25)
  TDMS Write(channel name(s) in=w24, data=w25, error in=w22, group name in=w1, tdms file=w23) -> (error out=w26, tdms file out=w27)
  TDMS Set Properties(error in=w26, group name=w1, property names=w2, property values=$"Cutoff Frequency", tdms file=w27) -> (error out=w28, tdms file out=w29)
  TDMS Close(error in=w28, tdms file=w29) -> (error out=w30)
  call "Display Error.gvi"(error in=w30)
  $"Acquired Data" <- w18
  $"Filtered Data" <- w25
