vi "TDMS Reader.gvi"   [LabVIEW NXG 1.0.0]
panel controls:
  "Channel Group": string
panel indicators:
  "Operator": string
  "Time of Acquisition": timestamp
  "Graph": waveform<f64>[]
  "Property Names": string[]
  "Property Values": variant[]
uses:
  NI::G Core::Error::Display Error.gvi
diagram:
  w1 = timestamp 1904-01-01T00:00:00Z  # data type (timestamp)
  Get Component Directory() -> (Path=w2)
  File Dialog[FileDialogSelectionMode=File, NewOrExistingMode=New](pattern (all files)="*.tdms", pattern label="TDMS File", prompt="Specify TDMS file to read", start path=w2) -> (error out=w3, selected path=w4)
  TDMS Open(error in=w3, file path=w4, operation="open") -> (error out=w5, tdms file out=w6)
  w7 = string ""  # data type (string)
  TDMS Get Properties(data type=w7, error in=w5, property name="Author", tdms file=w6) -> (error out=w8, property values=w9, tdms file out=w10)
  TDMS Get Properties(data type=w1, error in=w8, property name="Timestamp", tdms file=w10) -> (error out=w11, property values=w12, tdms file out=w13)
  TDMS Read(error in=w11, group name in=$"Channel Group", tdms file=w13) -> (data=w14, error out=w15, tdms file out=w16)
  TDMS Get Properties(error in=w15, group name=$"Channel Group", tdms file=w16) -> (error out=w17, property names=w18, property values=w19, tdms file out=w20)
  TDMS Close(error in=w17, tdms file=w20) -> (error out=w21)
  call "Display Error.gvi"(error in=w21)
  $Operator <- w9
  $"Time of Acquisition" <- w12
  $Graph <- w14
  $"Property Values" <- w19
  $"Property Names" <- w18
