vi "Simulated Read (1D Waveform).gvi"   [LabVIEW NXG 1.0.0]
inputs:
  "error in": error
outputs:
  "data": waveform<f64>[]
  "error out": error
uses:
  NI::Analysis::Generation::Sine Waveform.gvi
  NI::Analysis::Generation::Uniform White Noise Waveform.gvi
diagram:
  call "Sine Waveform.gvi"(amplitude=1, frequency=1, phase in=0, error in=$"error in") -> (sine wave=w1, error out=w2)
  call "Sine Waveform.gvi"(amplitude=0.75, frequency=5, phase in=180, error in=w2) -> (sine wave=w3, error out=w4)
  call "Sine Waveform.gvi"(amplitude=0.5, frequency=10, phase in=0, error in=w4) -> (sine wave=w5, error out=w6)
  call "Sine Waveform.gvi"(amplitude=0.25, frequency=10, phase in=90, error in=w6) -> (sine wave=w7, error out=w8)
  Build Array(w1, w3, w5, w7) -> w9
  call "Uniform White Noise Waveform.gvi"(amplitude=0.1) -> (uniform white noise=w10)
  Waveform Add(w9, w10) -> w11
  $data <- w11
  $"error out" <- w8
