vi "Stream to Text File (1Chan 1Samp).gvi"   [LabVIEW NXG 1.0.0]
panel controls:
  "Thermocouple Channel": "Physical Channel" = "cDAQ1Mod2/ai0"
  "Stop": bool
  "Measurement Range (deg C)": T1 = {"maximum value"=100, "minimum value"=0}
panel indicators:
  "Waveform Chart": f64
types:
  T1 = cluster{"maximum value": f64, "minimum value": f64}
uses:
  NI::G Core::Error::Display Error.gvi
diagram:
  w1 = 1  # sample rate (Hz)
  call "DAQmx Create Channel (AI-Temperature-Thermocouple).gvi"(physical channels=$"Thermocouple Channel", measurement range=$"Measurement Range (deg C)") -> (error out=w2, task out=w3)
  call "DAQmx Timing (Sample Clock).gvi"(error in=w2, task in=w3, rate=w1, sample mode="Continuous Samples"(10123)) -> (error out=w4, task out=w5)
  call "DAQmx Start Task.gvi"(error in=w4, task in=w5) -> (error out=w6, task out=w7)
  while {
    call "DAQmx Read (Analog DBL 1Chan 1Samp).gvi"(error in=w6, task in=w7) -> (error out=w8, task out=w9, data=w10)
    $"Waveform Chart" <- w10
    Logical Or(w8, $Stop) -> w11
    stop if w11
  }
  call "DAQmx Clear Task.gvi"(error in=w8, task in=w9) -> (error out=w12)
  call "Display Error.gvi"(error in=w12)
