vi "Low-Level Stream to Text File (NChan 1Samp).gvi"   [LabVIEW NXG 1.0.0]
panel controls:
  "Thermocouple Channels": "Physical Channel" = "cDAQ1Mod2/ai0:3"
  "Stop": bool
  "Measurement Range (deg C)": T2 = {"maximum value"=100, "minimum value"=0}
panel indicators:
  "Chart": T1
types:
  T1 = cluster{"Element 0": f64, "Element 1": f64, "Element 2": f64, "Element 3": f64}
  T2 = cluster{"maximum value": f64, "minimum value": f64}
uses:
  NI::G Core::Error::Display Error.gvi
diagram:
  w1 = "replace or create"  # operation
  Open Or Create Or Replace File(operation (0:open)=w1) -> (error out=w2, refnum out=w3)  # Open/Create/Replace File
  w4 = ["Thermocouple 0 (deg C)", "Thermocouple 1 (deg C)", "Thermocouple 2 (deg C)", "Thermocouple 3 (deg C)"]  # Text File Column headers
  Array To Spreadsheet String(array=w4, format string="") -> (spreadsheet string=w5)
  Write To Text File(error in=w2, file (use dialog)=w3, text=w5) -> (error out=w6, refnum out=w7)
  w8 = 1  # sample rate (Hz)
  call "DAQmx Create Channel (AI-Temperature-Thermocouple).gvi"(error in=w6, physical channels=$"Thermocouple Channels", measurement range=$"Measurement Range (deg C)") -> (error out=w9, task out=w10)
  call "DAQmx Timing (Sample Clock).gvi"(error in=w9, task in=w10, rate=w8, sample mode="Continuous Samples"(10123)) -> (error out=w11, task out=w12)
  call "DAQmx Start Task.gvi"(error in=w11, task in=w12) -> (error out=w13, task out=w14)
  while {
    call "DAQmx Read (Analog 1D DBL NChan 1Samp).gvi"(error in=w13, task in=w14) -> (error out=w15, task out=w16, data=w17)
    Array To Cluster[NumberOfClusterElements=4](array=w17) -> (cluster=w18)
    $Chart <- w18
    Array To Spreadsheet String(array=w17, format string="%.3f") -> (spreadsheet string=w19)
    Write To Text File(error in=w15, file (use dialog)=w7, text=w19) -> (error out=w20, refnum out=w21)
    Logical Or(w20, $Stop) -> w22
    stop if w22
  }
  call "DAQmx Clear Task.gvi"(error in=w20, task in=w16) -> (error out=w23)
  Close File(error in=w23, refnum=w21) -> (error out=w24)
  call "Display Error.gvi"(error in=w24)
