vi "Low-Level Stream to Text File (NChan NSamp).gvi"   [LabVIEW NXG 1.0.0]
panel controls:
  "Thermocouple Channels": "Physical Channel" = "cDAQ1Mod2/ai0:3"
  "Stop": bool
  "Desired Sample Rate (Hz)": f64 = 10
  "Number of Samples": i32 = 5
  "Measurement Range (deg C)": T1 = {"maximum value"=100, "minimum value"=0}
panel indicators:
  "Chart": f64[][]
  "Actual Sample Rate (Hz)": f64
types:
  T1 = cluster{"maximum value": f64, "minimum value": f64}
uses:
  NI::G Core::Error::Display Error.gvi
diagram:
  w1 = $"Number of Samples"
  w2 = "replace or create"  # operation
  Open Or Create Or Replace File(operation (0:open)=w2) -> (error out=w3, refnum out=w4)  # Open/Create/Replace File
  w5 = ["Thermocouple 0 (deg C)", "Thermocouple 1 (deg C)", "Thermocouple 2 (deg C)", "Thermocouple 3 (deg C)"]  # Text File Column headers
  Array To Spreadsheet String(array=w5, format string="") -> (spreadsheet string=w6)
  Write To Text File(error in=w3, file (use dialog)=w4, text=w6) -> (error out=w7, refnum out=w8)
  w9 = "Continuous Samples"(10123)  # Sample Mode
  call "DAQmx Create Channel (AI-Temperature-Thermocouple).gvi"(error in=w7, physical channels=$"Thermocouple Channels", measurement range=$"Measurement Range (deg C)") -> (error out=w10, task out=w11)
  call "DAQmx Timing (Sample Clock).gvi"(error in=w10, task in=w11, rate=$"Desired Sample Rate (Hz)", sample mode=w9, samples per channel=w1) -> (error out=w12, task out=w13)
  Property Node(instance in=w13, error in=w12) -> ("SampClk_Rate_1344"=w14, error out=w15, instance out=w16)
  call "DAQmx Start Task.gvi"(error in=w15, task in=w16) -> (error out=w17, task out=w18)
  while {
    call "DAQmx Read (Analog 2D DBL NChan NSamp).gvi"(error in=w17, task in=w18, number of samples per channel=w1) -> (error out=w19, task out=w20, data=w21)
    Transpose 2D Array(2D array=w21) -> (transposed array=w22)
    $Chart <- w22
    Array To Spreadsheet String(array=w22, format string="%.3f") -> (spreadsheet string=w23)
    Write To Text File(error in=w19, file (use dialog)=w8, text=w23) -> (error out=w24, refnum out=w25)
    Logical Or(w24, $Stop) -> w26
    stop if w26
  }
  call "DAQmx Clear Task.gvi"(error in=w24, task in=w20) -> (error out=w27)
  Close File(error in=w27, refnum=w25) -> (error out=w28)
  call "Display Error.gvi"(error in=w28)
  $"Actual Sample Rate (Hz)" <- w14
