vi "Measurement Panel Task Method.gvi"   [LabVIEW NXG 1.0.0]
panel controls:
  "Number of Samples": i32 = 2560
panel indicators:
  "Data": waveform<f64>
diagram:
  # DAQmx Start Task
  call "DAQmx Start Task.gvi"(task in="My Analog Input Voltage") -> (task out=w1)
  # DAQmx Read
  call "DAQmx Read (Analog Wfm 1Chan NSamp).gvi"(task in=w1, number of samples per channel=$"Number of Samples") -> (task out=w2, data=w3)
  # DAQmx Clear Task
  call "DAQmx Clear Task.gvi"(task in=w2)
  $Data <- w3
