vi "Determine Warnings.gvi"   [LabVIEW NXG 1.0.0]
# In this exercise, you put the inputs and outputs into a cluster.
inputs:
  "Weather Data In": "Weather Data.gtype", required
  "Error In": error
outputs:
  "Weather Data Out": "Weather Data.gtype"
  "Error Out": error
types:
  "Weather Data.gtype" = cluster{"Current Temperature": f64, "Max Temperature": f64, "Min Temperature": f64, "Warning?": bool, "Warning Text": string}
diagram:
  Property Node(instance in=$"Weather Data In") -> ("Current Temperature"=w1, "Max Temperature"=w2, "Min Temperature"=w3)  # Cluster Properties
  # If Current Temperature <= Min Temperature, output a Freeze Warning.
  Is Less Or Equal(x=w1, y=w3) -> w4
  Is Greater Or Equal(x=w1, y=w2) -> w5
  # If Current Temperature >= Max Temperature, output a Heatstroke Warning.
  Select(s=w5, t="Heatstroke Warning", f="No Warning") -> w6
  Select(s=w4, t="Freeze Warning", f=w6) -> w7
  Is Not Equal(x="No Warning", y=w7) -> w8
  Property Node(instance in=$"Weather Data In", "Warning?"=w8, "Warning Text"=w7) -> (instance out=w9)  # Cluster Properties
  $"Weather Data Out" <- w9
  $"Error Out" <- $"Error In"
