vi "Weather Station UI.gvi"   [LabVIEW NXG 1.0.0]
panel controls:
  "Upper Limit": f64 = 30
  "Lower Limit": f64 = 20
  "Stop": bool
  "Thermocouple Channel": "Physical Channel" = "cDAQ1Mod2/ai0"
panel indicators:
  "Temperature History": f64
  "Warning": string
types:
  T1 = cluster{"maximum value": f64, "minimum value": f64}
uses:
  NI::G Core::Timing::Elapsed Timer.gvi
  NI::G Core::Error::Display Error.gvi
diagram:
  w1 = T1 {"maximum value"=50, "minimum value"=-10}  # measurement range (deg C)
  call "DAQmx Create Channel (AI-Temperature-Thermocouple).gvi"(physical channels=$"Thermocouple Channel", measurement range=w1, thermocouple type="J"(10072)) -> (error out=w2, task out=w3)
  call "DAQmx Start Task.gvi"(error in=w2, task in=w3) -> (error out=w4, task out=w5)
  File Dialog[FileDialogSelectionMode=File, NewOrExistingMode=New](default name="Weather Warning Log.txt", error in=w4, pattern (all files)="*.txt", prompt="Specify a log file path") -> (error out=w6, selected path=w7)
  Open Or Create Or Replace File(error in=w6, file path (use dialog)=w7, operation (0:open)="replace or create") -> (error out=w8, refnum out=w9)
  s1 = TRUE  # shift register
  while (after w8) (after w9) (after w5) {
    case (_) {
      frame False, Default { }
      frame True { }
    }
    call "Elapsed Timer.gvi"(target time=0.5, reset=s1)
    w10 = _
    w11 = _
    w12 = _
    next s1 = _
    stop if _
  }
  Close File(error in=w10, refnum=w11) -> (error out=w13)
  call "DAQmx Clear Task.gvi"(error in=w13, task in=w12) -> (error out=w14)
  call "Display Error.gvi"(error in=w14)
