vi "Generate Timestamped Filepath.gvi"   [LabVIEW NXG 1.0.0]
panel indicators:
  "Timestamped Filepath": path
diagram:
  Get Component Directory() -> (Path=w1)
  w2 = "%Y%m%d_%H%M%S_Acquired Data.txt"  # time format string
  Get Current Time() -> (current time=w3)
  Format Date Time String(time format string (%c)=w2, time stamp=w3) -> (date/time string=w4)  # Format Date and Time String
  Build Path(base path=w1, name or relative path=w4) -> (appended path=w5)
  $"Timestamped Filepath" <- w5
