vi "[Timestamped File] High-Level Write to Text File.gvi"   [LabVIEW NXG 1.0.0]
panel controls:
  "Physical Channels": "Physical Channel" = "cDAQ1Mod8/ai0:3"
  "Desired Sample Rate (Hz)": f64 = 1000
  "Number of Samples": i32 = 100
  "Measurement Range (V)": T1 = {"maximum value"=5, "minimum value"=-5}
panel indicators:
  "Graph": f64[][]
  "Actual Sample Rate (Hz)": f64
types:
  T1 = cluster{"maximum value": f64, "minimum value": f64}
uses:
  NI::G Core::File IO (General)::Write Delimited Spreadsheet (string).gvi
  NI::G Core::File IO (General)::Write Delimited Spreadsheet (DBL).gvi
  NI::G Core::Error::Display Error.gvi
diagram:
  w1 = "Finite Samples"(10178)  # Sample Mode
  call "DAQmx Create Channel (AI-Voltage-Basic).gvi"(physical channels=$"Physical Channels", measurement range=$"Measurement Range (V)") -> (error out=w2, task out=w3)
  call "DAQmx Timing (Sample Clock).gvi"(error in=w2, task in=w3, rate=$"Desired Sample Rate (Hz)", sample mode=w1, samples per channel=$"Number of Samples") -> (error out=w4, task out=w5)
  Property Node(instance in=w5, error in=w4) -> ("SampClk_Rate_1344"=w6, error out=w7, instance out=w8)
  call "DAQmx Start Task.gvi"(error in=w7, task in=w8) -> (error out=w9, task out=w10)
  call "DAQmx Read (Analog 2D DBL NChan NSamp).gvi"(error in=w9, task in=w10) -> (error out=w11, task out=w12, data=w13)
  $Graph <- w13
  call "DAQmx Stop Task.gvi"(error in=w11, task in=w12) -> (error out=w14, task out=w15)
  call "DAQmx Clear Task.gvi"(error in=w14, task in=w15) -> (error out=w16)
  Get Component Directory() -> (Path=w17)
  w18 = "%Y%m%d_%H%M%S_Acquired Data.txt"  # time format string
  Get Current Time() -> (current time=w19)
  Format Date Time String(time format string (%c)=w18, time stamp=w19) -> (date/time string=w20)  # Format Date and Time String
  Build Path(base path=w17, name or relative path=w20) -> (appended path=w21)
  # Write
  # Header
  call "Write Delimited Spreadsheet (string).gvi"(file=w21, 2D data=[["Channel 0", "Channel 1", "Channel 2", "Channel 3"]], error in=w16) -> (new file=w22, error out=w23)
  Transpose 2D Array(2D array=w13) -> (transposed array=w24)
  w25 = TRUE  # append to file?
  # Write
  # Data
  call "Write Delimited Spreadsheet (DBL).gvi"(file=w22, 2D data=w24, append to file=w25, error in=w23) -> (error out=w26)
  call "Display Error.gvi"(error in=w26)
  $"Actual Sample Rate (Hz)" <- w6
