vi "Set Loop Period.gvi"   [LabVIEW NXG 1.0.0]
panel controls:
  "stop": bool
panel indicators:
  "Chart": f64
diagram:
  while (iteration -> i1) {
    To Double Precision Float(number=i1) -> w1
    Multiply(w1, 0.05, f64 default) -> w2
    Sine(x=w2) -> w3
    $Chart <- w3
    stop if $stop
  }
