vi "Finite Acquisition.gvi"   [LabVIEW NXG 1.0.0]
panel controls:
  "Desired Sample Rate (Hz)": f64 = 1000
  "Physical Channel": "Physical Channel" = "cDAQ1Mod8/ai0"
  "Number of Samples": i32 = 1000
panel indicators:
  "Data": waveform<f64>
  "Actual Sample Rate (Hz)": f64
types:
  T1 = cluster{"maximum value": f64, "minimum value": f64}
uses:
  NI::G Core::Error::Display Error.gvi
diagram:
  call "DAQmx Create Channel (AI-Voltage-Basic).gvi"(physical channels=$"Physical Channel", measurement range=T1 {"maximum value"=5, "minimum value"=-5}) -> (error out=w1, task out=w2)
  call "DAQmx Timing (Sample Clock).gvi"(error in=w1, task in=w2, rate=$"Desired Sample Rate (Hz)", sample mode="Finite Samples"(10178), samples per channel=$"Number of Samples") -> (error out=w3, task out=w4)
  Property Node(instance in=w4, error in=w3) -> ("SampClk_Rate_1344"=w5, error out=w6, instance out=w7)
  call "DAQmx Start Task.gvi"(error in=w6, task in=w7) -> (error out=w8, task out=w9)
  call "DAQmx Read (Analog Wfm 1Chan NSamp).gvi"(error in=w8, task in=w9, number of samples per channel=$"Number of Samples") -> (error out=w10, task out=w11, data=w12)
  call "DAQmx Clear Task.gvi"(error in=w10, task in=w11) -> (error out=w13)
  call "Display Error.gvi"(error in=w13)
  $"Actual Sample Rate (Hz)" <- w5
  $Data <- w12
