vi "High-Level Write to Text File - N-Channel.gvi"   [LabVIEW NXG 1.0.0]
panel controls:
  "Physical Channel": "Physical Channel" = "cDAQ1Mod8/ai0:3"
  "Desired Sample Rate (Hz)": f64 = 1000
  "Number of Samples": i32 = 100
  "Data log filepath": path
  "Measurement Range": T1 = {"maximum value"=5, "minimum value"=-5}
panel indicators:
  "Waveform Graph": f64[][]
  "Actual Sample Rate (Hz)": f64
types:
  T1 = cluster{"maximum value": f64, "minimum value": f64}
uses:
  NI::G Core::File IO (General)::Write Delimited Spreadsheet (string).gvi
  NI::G Core::File IO (General)::Write Delimited Spreadsheet (DBL).gvi
  NI::G Core::Error::Display Error.gvi
diagram:
  w1 = "Finite Samples"(10178)  # Sample Mode
  call "DAQmx Create Channel (AI-Voltage-Basic).gvi"(physical channels=$"Physical Channel", measurement range=$"Measurement Range") -> (error out=w2, task out=w3)
  call "DAQmx Timing (Sample Clock).gvi"(error in=w2, task in=w3, rate=$"Desired Sample Rate (Hz)", sample mode=w1, samples per channel=$"Number of Samples") -> (error out=w4, task out=w5)
  Property Node(instance in=w5, error in=w4) -> ("SampClk_Rate_1344"=w6, error out=w7, instance out=w8)
  call "DAQmx Start Task.gvi"(error in=w7, task in=w8) -> (error out=w9, task out=w10)
  call "DAQmx Read (Analog 2D DBL NChan NSamp).gvi"(error in=w9, task in=w10) -> (error out=w11, task out=w12, data=w13)
  $"Waveform Graph" <- w13
  call "DAQmx Clear Task.gvi"(error in=w11, task in=w12) -> (error out=w14)
  # Write
  # Header
  call "Write Delimited Spreadsheet (string).gvi"(file=$"Data log filepath", 2D data=[["Channel 0", "Channel 1", "Channel 2", "Channel 3"]], error in=w14) -> (new file=w15, error out=w16)
  Transpose 2D Array(2D array=w13) -> (transposed array=w17)
  w18 = TRUE  # append to file?
  # Write
  # Data
  call "Write Delimited Spreadsheet (DBL).gvi"(file=w15, 2D data=w17, append to file=w18, error in=w16) -> (error out=w19)
  call "Display Error.gvi"(error in=w19)
  $"Actual Sample Rate (Hz)" <- w6
