vi "Stream to Text File (1Chan 1Samp).gvi"   [LabVIEW NXG 1.0.0]
panel controls:
  "Thermocouple Channel": "Physical Channel" = "cDAQ1Mod2/ai0"
  "Stop": bool
  "Measurement Range (deg C)": T1 = {"maximum value"=100, "minimum value"=0}
panel indicators:
  "Waveform Chart": f64
types:
  T1 = cluster{"maximum value": f64, "minimum value": f64}
uses:
  NI::G Core::Error::Display Error.gvi
diagram:
  w1 = "replace or create"  # operation
  Open Or Create Or Replace File(operation (0:open)=w1) -> (error out=w2, refnum out=w3)  # Open/Create/Replace File
  w4 = "\r\n"  # End of Line Constant
  Concatenate Strings("Temperature (deg C)", w4) -> w5
  Write To Text File(error in=w2, file (use dialog)=w3, text=w5) -> (error out=w6, refnum out=w7)
  w8 = 1  # sample rate (Hz)
  call "DAQmx Create Channel (AI-Temperature-Thermocouple).gvi"(error in=w6, physical channels=$"Thermocouple Channel", measurement range=$"Measurement Range (deg C)") -> (error out=w9, task out=w10)
  call "DAQmx Timing (Sample Clock).gvi"(error in=w9, task in=w10, rate=w8, sample mode="Continuous Samples"(10123)) -> (error out=w11, task out=w12)
  call "DAQmx Start Task.gvi"(error in=w11, task in=w12) -> (error out=w13, task out=w14)
  while {
    call "DAQmx Read (Analog DBL 1Chan 1Samp).gvi"(error in=w13, task in=w14) -> (error out=w15, task out=w16, data=w17)
    $"Waveform Chart" <- w17
    w18 = "%.3f%s"  # format string
    w19 = "\r\n"  # End of Line Constant
    Format Into String(formatString=w18, errIn=w15, w17, w19) -> (outString=w20, errOut=w21)
    Write To Text File(error in=w21, file (use dialog)=w7, text=w20) -> (error out=w22, refnum out=w23)
    Logical Or(w22, $Stop) -> w24
    stop if w24
  }
  call "DAQmx Clear Task.gvi"(error in=w22, task in=w16) -> (error out=w25)
  Close File(error in=w25, refnum=w23) -> (error out=w26)
  call "Display Error.gvi"(error in=w26)
