vi "[Challenge] Read Delimited File into VI and Analyze.gvi"   [LabVIEW NXG 1.0.0]
outputs:
  "Data with first line header deleted": f64[][]
panel indicators:
  "First row (header strings)": string[]
  "Max Values Per Channel": f64[]
  "Min Values Per Channel": f64[]
  "Graph": f64[][]
uses:
  NI::G Core::File IO (General)::Read Delimited Spreadsheet (string).gvi
  NI::G Core::File IO (General)::Read Delimited Spreadsheet (DBL).gvi
  NI::G Core::Error::Display Error.gvi
diagram:
  Get Component Directory() -> (Path=w1)
  File Dialog[FileDialogSelectionMode=File, NewOrExistingMode=New](start path=w1) -> (error out=w2, selected path=w3)
  call "Read Delimited Spreadsheet (string).gvi"(file=w3, error in=w2) -> (new file=w4, all rows=w5, error out=w6)
  call "Read Delimited Spreadsheet (DBL).gvi"(file=w4, error in=w6) -> (all rows=w7, error out=w8)
  call "Display Error.gvi"(error in=w8)
  w9 = 0  # row index
  Array Index(array=w5) -> (out0[w9, _]=w10)
  $"First row (header strings)" <- w10
  w11 = 1  # row index
  Array Subset(array=w7, index0=w11) -> w12
  $"Data with first line header deleted" <- w12
  Transpose 2D Array(2D array=w12) -> (transposed array=w13)
  $Graph <- w13
  for {
    w14 = each element of w13
    Array Max And Min(array=w14) -> (max value=w17, min value=w18)
    append w17 to w15
    append w18 to w16
  }
  $"Max Values Per Channel" <- w15
  $"Min Values Per Channel" <- w16
