vi "Main.gvi"   [LabVIEW NXG 1.0.0]
panel controls:
  "Physical Channel": "Physical Channel" = "cDAQ1Mod7/ai0"
  "Desired Sample Rate (Hz)": f64 = 1000
  "Number of Samples": i32 = 100
  "Measurement Range (V)": T1 = {"maximum value"=5, "minimum value"=-5}
panel indicators:
  "Actual Sample Rate (Hz)": f64
  "Voltage": waveform<f64>
  "Acceleration": waveform<f64>
types:
  T1 = cluster{"maximum value": f64, "minimum value": f64}
uses:
  NI::G Core::Error::Display Error.gvi
diagram:
  w1 = "Finite Samples"(10178)  # Sample Mode
  call "DAQmx Create Channel (AI-Voltage-Basic).gvi"(physical channels=$"Physical Channel", measurement range=$"Measurement Range (V)") -> (error out=w2, task out=w3)
  call "DAQmx Timing (Sample Clock).gvi"(error in=w2, task in=w3, rate=$"Desired Sample Rate (Hz)", sample mode=w1, samples per channel=$"Number of Samples") -> (error out=w4, task out=w5)
  Property Node(instance in=w5, error in=w4) -> ("SampClk_Rate_1344"=w6, error out=w7, instance out=w8)
  call "DAQmx Start Task.gvi"(error in=w7, task in=w8) -> (error out=w9, task out=w10)
  call "DAQmx Read (Analog Wfm 1Chan NSamp).gvi"(error in=w9, task in=w10) -> (error out=w11, task out=w12, data=w13)
  call "Convert Voltage to Acceleration.gvi"(Voltage Waveform (V)=w13) -> (Acceleration Waveform (g)=w14)
  $Acceleration <- w14
  $Voltage <- w13
  call "DAQmx Clear Task.gvi"(error in=w11, task in=w12) -> (error out=w15)
  call "Display Error.gvi"(error in=w15)
  $"Actual Sample Rate (Hz)" <- w6
