vi "Main.gvi"   [LabVIEW NXG 1.0.0]
panel controls:
  "Thermocouple Channel": "Physical Channel" = "cDAQ1Mod2/ai0"
  "Stop": bool
  "Measurement Range (deg C)": T1 = {"maximum value"=100, "minimum value"=0}
panel indicators:
  "Waveform Chart": f64
types:
  T1 = cluster{"maximum value": f64, "minimum value": f64}
uses:
  NI::G Core::Error::Display Error.gvi
diagram:
  call "Generate Timestamped Filepath.gvi"(appended filename="MyData") -> (timestamped relative filepath=w1, error out=w2)
  Open Or Create Or Replace File(error in=w2, file path (use dialog)=w1, operation (0:open)="replace or create") -> (error out=w3, refnum out=w4)  # Open/Create/Replace File
  w5 = "\r\n"  # End of Line Constant
  Concatenate Strings("Temperature (deg C)", w5) -> w6
  Write To Text File(error in=w3, file (use dialog)=w4, text=w6) -> (error out=w7, refnum out=w8)
  w9 = 1  # sample rate (Hz)
  call "DAQmx Create Channel (AI-Temperature-Thermocouple).gvi"(error in=w7, physical channels=$"Thermocouple Channel", measurement range=$"Measurement Range (deg C)") -> (error out=w10, task out=w11)
  call "DAQmx Timing (Sample Clock).gvi"(error in=w10, task in=w11, rate=w9, sample mode="Continuous Samples"(10123)) -> (error out=w12, task out=w13)
  call "DAQmx Start Task.gvi"(error in=w12, task in=w13) -> (error out=w14, task out=w15)
  while {
    call "DAQmx Read (Analog DBL 1Chan 1Samp).gvi"(error in=w14, task in=w15) -> (error out=w16, task out=w17, data=w18)
    $"Waveform Chart" <- w18
    w19 = "%.3f%s"  # format string
    w20 = "\r\n"  # End of Line Constant
    Format Into String(formatString=w19, errIn=w16, w18, w20) -> (outString=w21, errOut=w22)
    Write To Text File(error in=w22, file (use dialog)=w8, text=w21) -> (error out=w23, refnum out=w24)
    Logical Or(w23, $Stop) -> w25
    stop if w25
  }
  call "DAQmx Stop Task.gvi"(error in=w23, task in=w17) -> (error out=w26, task out=w27)
  call "DAQmx Clear Task.gvi"(error in=w26, task in=w27) -> (error out=w28)
  Close File(error in=w28, refnum=w24) -> (error out=w29)
  call "Display Error.gvi"(error in=w29)
