vi "Generate Timestamped Filepath.gvi"   [LabVIEW NXG 1.0.0]
# Generates a timestamped filepath with an appended user-specified name and the same directory containing the project
inputs:
  "appended filename": string, required
  "error in": error
outputs:
  "timestamped relative filepath": path
  "error out": error
diagram:
  case ($"error in") {
    frame Error {
      w1 = path ""
      w2 = $"error in"
    }
    frame No Error {
      Concatenate Strings("%Y%m%d_%H%M%S_", $"appended filename", ".txt") -> w3
      Get Current Time() -> (current time=w4)
      Format Date Time String(time format string (%c)=w3, time stamp=w4) -> (date/time string=w5)  # Format Date and Time String
      Get Component Directory() -> (Path=w6)
      Build Path(base path=w6, name or relative path=w5) -> (appended path=w1)
      w2 = $"error in"
    }
  }
  $"timestamped relative filepath" <- w1
  $"error out" <- w2
