vi "Determine Warnings.gvi"   [LabVIEW NXG 1.0.0]
# In this exercise, you put the inputs and outputs into a cluster.
inputs:
  "Error In": error
outputs:
  "Error Out": error
panel controls:
  "Weather Data In": T1
panel indicators:
  "Weather Data Out": T1
types:
  T1 = cluster{"Current Temperature": f64, "Max Temperature": f64, "Min Temperature": f64, "Warning?": bool, "Warning Text": string}
diagram:
  Property Node(instance in=$"Weather Data In") -> ("Current Temperature"=w1, "Max Temperature"=w2, "Min Temperature"=w3, instance out=w4)  # Cluster Properties
  # If Current Temperature <= Min Temperature, output a Freeze Warning.
  Is Less Or Equal(x=w1, y=w3) -> w5
  Is Greater Or Equal(x=w1, y=w2) -> w6
  # If Current Temperature >= Max Temperature, output a Heatstroke Warning.
  Select(s=w6, t="Heatstroke Warning", f="No Warning") -> w7
  Select(s=w5, t="Freeze Warning", f=w7) -> w8
  Is Not Equal(x="No Warning", y=w8) -> w9
  Property Node(instance in=w4, "Warning?"=w9, "Warning Text"=w8) -> (instance out=w10)  # Cluster Properties
  $"Weather Data Out" <- w10
  $"Error Out" <- $"Error In"
