vi "Main.gvi"   [LabVIEW NXG 1.0.0]
panel controls:
  "Stop": bool  # Stop stops the acquisition. It is recommended to stop your VI through this stop button so the DAQmx task can be properly cleared.
  "Upper Limit": f64 = 30
  "Lower Limit": f64 = 20
  "Thermocouple Channel": "Physical Channel" = "cDAQ1Mod2/ai0"
panel indicators:
  "Chart": f64  # Waveform Graph displays the most recent acquired data.
  "Weather Data": "Weather Data.gtype"
types:
  "Weather Data.gtype" = cluster{"Current Temperature": f64, "Max Temperature": f64, "Min Temperature": f64, "Warning?": bool, "Warning Text": string, "Current Windspeed": f64}
  T1 = cluster{"maximum value": f64, "minimum value": f64}
uses:
  NI::G Core::Error::Display Error.gvi
diagram:
  Get Component Directory() -> (Path=w1)
  Build Path(base path=w1, name or relative path="Temperature Warnings.txt") -> (appended path=w2)
  Open Or Create Or Replace File(file path (use dialog)=w2, operation (0:open)="open or create") -> (error out=w3, refnum out=w4)
  call "DAQmx Create Channel (AI-Temperature-Thermocouple).gvi"(error in=w3, physical channels=$"Thermocouple Channel", units="Deg C"(10143), measurement range=T1 {"maximum value"=40, "minimum value"=15}, thermocouple type="J"(10072)) -> (error out=w5, task out=w6)
  call "DAQmx Timing (Sample Clock).gvi"(error in=w5, task in=w6, rate=1, sample mode="Continuous Samples"(10123)) -> (error out=w7, task out=w8)
  call "DAQmx Start Task.gvi"(error in=w7, task in=w8) -> (error out=w9, task out=w10)
  while {
    call "DAQmx Read (Analog DBL 1Chan 1Samp).gvi"(error in=w9, task in=w10) -> (error out=w11, task out=w12, data=w13)
    Property Node(instance in="Weather Data.gtype" {all zero or empty}, "Max Temperature"=$"Upper Limit", "Min Temperature"=$"Lower Limit", "Current Temperature"=w13) -> (instance out=w14)
    call "Determine Warnings.gvi"(Weather Data In=w14, Error In=w11) -> (Weather Data Out=w15, Error Out=w16)
    $"Weather Data" <- w15
    $Chart <- w13
    Property Node(instance in=w15) -> ("Warning?"=w17)
    case (w17) {
      frame False, Default {
        w18 = w16
        w19 = w4
      }
      frame True {
        call "Log Warnings.gvi"(Weather Data=w15, file ref in=w4, error in=w16) -> (file ref out=w19, error out=w18)
      }
    }
    Logical Or(w18, $Stop) -> w20
    stop if w20
  }
  call "DAQmx Stop Task.gvi"(error in=w18, task in=w12) -> (error out=w21, task out=w22)
  call "DAQmx Clear Task.gvi"(error in=w21, task in=w22) -> (error out=w23)
  Close File(error in=w23, refnum=w19) -> (error out=w24)
  call "Display Error.gvi"(error in=w24)
