vi "Log Warnings.gvi"   [LabVIEW NXG 1.0.0]
inputs:
  "Weather Data": "Weather Data.gtype"
  "file ref in": ByteStreamFileRefnum
  "error in": error
outputs:
  "file ref out": ByteStreamFileRefnum
  "error out": error
types:
  "Weather Data.gtype" = cluster{"Current Temperature": f64, "Max Temperature": f64, "Min Temperature": f64, "Warning?": bool, "Warning Text": string, "Current Windspeed": f64}
diagram:
  Property Node(instance in=$"Weather Data") -> ("Current Temperature"=w1, "Max Temperature"=w2, "Min Temperature"=w3, "Warning?"=w4, "Warning Text"=w5)
  Format Into String(w1, "\t", w2, "\t", w3, "\t", w4, "\t", w5, "\r\n") -> w6
  Write To Text File(error in=$"error in", file (use dialog)=$"file ref in", text=w6) -> (error out=w7, refnum out=w8)
  $"file ref out" <- w8
  $"error out" <- w7
