vi "Weather Station UI.gvi"   [LabVIEW NXG 1.0.0]
panel controls:
  "Upper Limit": f64 = 30
  "Lower Limit": f64 = 20
  "Stop": bool
  "Thermocouple Channel": "Physical Channel" = "cDAQ1Mod2/ai0"
panel indicators:
  "Temperature History": f64
  "Warning": string
types:
  "Weather Data.gtype" = cluster{"Current Temperature": f64, "Max Temperature": f64, "Min Temperature": f64, "Warning?": bool, "Warning Text": string}
  T1 = cluster{"maximum value": f64, "minimum value": f64}
uses:
  NI::G Core::Timing::Elapsed Timer.gvi
  NI::G Core::Error::Display Error.gvi
diagram:
  w1 = "Initialize"  # Beginning State
  s1 = w1  # shift register
  s2 = uninitialised  # shift register
  s3 = uninitialised  # shift register
  s4 = "Weather Data.gtype" {all zero or empty}  # shift register
  s5 = uninitialised  # shift register
  s6 = TRUE  # shift register
  while {
    call "Elapsed Timer.gvi"(target time=0.5, reset=s6) -> (time has elapsed=w2)
    case (s1) {
      frame "Initialize" {
        w10 = "Acquire"  # Next State
        call "DAQmx Create Channel (AI-Temperature-Thermocouple).gvi"(physical channels=$"Thermocouple Channel", measurement range=T1 {"maximum value"=50, "minimum value"=-10}, thermocouple type="J"(10072)) -> (error out=w11, task out=w12)
        call "DAQmx Start Task.gvi"(error in=w11, task in=w12) -> (error out=w13, task out=w3)
        File Dialog[FileDialogSelectionMode=File, NewOrExistingMode=New](default name="Weather Warning Log.txt", error in=w13, pattern (all files)="*.txt", prompt="Specify a log file path") -> (error out=w14, selected path=w15)
        Open Or Create Or Replace File(error in=w14, file path (use dialog)=w15, operation (0:open)="replace or create") -> (error out=w4, refnum out=w8)
        w5 = s4
        w6 = w10
        w7 = default
        w9 = default
      }
      frame "Acquire" {
        call "DAQmx Read (Analog DBL 1Chan 1Samp).gvi"(error in=s5, task in=s2) -> (error out=w4, task out=w3, data=w16)
        Property Node(instance in=s4, "Current Temperature"=w16) -> (instance out=w5)
        $"Temperature History" <- w16
        w17 = "Analyze"  # Next State
        # Reset Elapsed Time counter to begin timing until next acquisition
        w6 = w17
        w7 = TRUE
        w8 = s3
        w9 = default
      }
      frame "Analyze" {
        Property Node(instance in=s4, "Max Temperature"=$"Upper Limit", "Min Temperature"=$"Lower Limit") -> (instance out=w18)
        call "Temperature Warnings.gvi"(Weather Data In=w18, Error In=s5) -> (Weather Data Out=w19, Error Out=w4)
        Property Node(instance in=w19) -> ("Warning Text"=w20, "Warning?"=w21, instance out=w5)
        $Warning <- w20
        w22 = "Log"  # Next State
        Select(s=w21, t=w22, f="Check Time") -> w6
        w3 = s2
        w7 = default
        w8 = s3
        w9 = default
      }
      frame "Log" {
        w23 = "Check Time"  # Next State
        call "Log Warnings.gvi"(Weather Data=s4, file ref in=s3, error in=s5) -> (file ref out=w8, error out=w4)
        w3 = s2
        w5 = s4
        w6 = w23
        w7 = default
        w9 = default
      }
      frame "Check Time" {
        Wait(time to wait=10)
        w24 = "Acquire"  # Next State
        Select(s=w2, t=w24, f="Check Time") -> w6
        w3 = s2
        w4 = s5
        w5 = s4
        w7 = default
        w8 = s3
        w9 = default
      }
      frame "Shutdown" {
        w25 = "Shutdown"  # (not used because VI will have already stopped)
        Close File(error in=s5, refnum=s3) -> (error out=w26)
        call "DAQmx Clear Task.gvi"(error in=w26, task in=s2) -> (error out=w27)
        call "Display Error.gvi"(error in=w27)
        w28 = TRUE  # Exit VI
        w3 = ""
        w4 = no error
        w5 = s4
        w6 = w25
        w7 = default
        w8 = ByteStreamFileRefnum constant
        w9 = w28
      }
    }
    w29 = "Shutdown"  # Next State
    Logical Or($Stop, w4) -> w30
    Select(s=w30, t=w29, f=w6) -> w31
    next s1 = w31
    next s2 = w3
    next s3 = w8
    next s4 = w5
    next s5 = w4
    next s6 = w7
    stop if w9
  }
