vi "Weather Station UI.gvi"   [LabVIEW NXG 1.0.0]
panel controls:
  "Upper Limit": f64 = 30
  "Lower Limit": f64 = 20
  "Stop": bool
  "Thermocouple Channel": "Physical Channel" = "cDAQ1Mod2/ai0"
panel indicators:
  "Temperature History": f64
  "Warning": string
types:
  T1 = cluster{"maximum value": f64, "minimum value": f64}
  "Weather Data.gtype" = cluster{"Current Temperature": f64, "Max Temperature": f64, "Min Temperature": f64, "Warning?": bool, "Warning Text": string}
uses:
  NI::G Core::Timing::Elapsed Timer.gvi
  NI::G Core::Error::Display Error.gvi
diagram:
  w1 = T1 {"maximum value"=50, "minimum value"=-10}  # measurement range (deg C)
  call "DAQmx Create Channel (AI-Temperature-Thermocouple).gvi"(physical channels=$"Thermocouple Channel", measurement range=w1, thermocouple type="J"(10072)) -> (error out=w2, task out=w3)
  call "DAQmx Start Task.gvi"(error in=w2, task in=w3) -> (error out=w4, task out=w5)
  File Dialog[FileDialogSelectionMode=File, NewOrExistingMode=New](default name="Weather Warning Log.txt", error in=w4, pattern (all files)="*.txt", prompt="Specify a log file path") -> (error out=w6, selected path=w7)
  Open Or Create Or Replace File(error in=w6, file path (use dialog)=w7, operation (0:open)="replace or create") -> (error out=w8, refnum out=w9)
  w10 = "Acquire"  # Beginning State
  s1 = w10  # shift register
  s2 = "Weather Data.gtype" {all zero or empty}  # shift register
  s3 = TRUE  # shift register
  while {
    call "Elapsed Timer.gvi"(target time=0.5, reset=s3) -> (time has elapsed=w11)
    case (s1) {
      frame "Acquire" {
        call "DAQmx Read (Analog DBL 1Chan 1Samp).gvi"(error in=w8, task in=w5) -> (error out=w13, task out=w12, data=w19)
        Property Node(instance in=s2, "Current Temperature"=w19) -> (instance out=w14)
        $"Temperature History" <- w19
        w20 = "Analyze"  # Next State
        # Reset Elapsed Time counter to begin timing until next acquisition
        w15 = w20
        w16 = TRUE
        w17 = w9
        w18 = default
      }
      frame "Analyze" {
        Property Node(instance in=s2, "Max Temperature"=$"Upper Limit", "Min Temperature"=$"Lower Limit") -> (instance out=w21)
        call "Determine Warnings.gvi"(Weather Data In=w21, Error In=w8) -> (Weather Data Out=w22, Error Out=w13)
        Property Node(instance in=w22) -> ("Warning Text"=w23, "Warning?"=w24, instance out=w14)
        $Warning <- w23
        w25 = "Log"  # Next State
        Select(s=w24, t=w25, f="Check Time") -> w15
        w12 = w5
        w16 = default
        w17 = w9
        w18 = default
      }
      frame "Log" {
        w26 = "Check Time"  # Next State
        call "Log Warnings.gvi"(Weather Data=s2, file ref in=w9, error in=w8) -> (file ref out=w17, error out=w13)
        w12 = w5
        w14 = s2
        w15 = w26
        w16 = default
        w18 = default
      }
      frame "Check Time" {
        Wait(time to wait=10)
        w27 = "Acquire"  # Next State
        Select(s=w11, t=w27, f="Check Time") -> w15
        w12 = w5
        w13 = w8
        w14 = s2
        w16 = default
        w17 = w9
        w18 = $Stop
      }
    }
    Logical Or(w13, w18) -> w28
    next s1 = w15
    next s2 = w14
    next s3 = w16
    stop if w28
  }
  Close File(error in=w13, refnum=w17) -> (error out=w29)
  call "DAQmx Clear Task.gvi"(error in=w29, task in=w12) -> (error out=w30)
  call "Display Error.gvi"(error in=w30)
