vi "Average.gvi"   [LabVIEW NXG 1.0.0]
panel controls:
  "X1": f64
  "X2": f64
  "X3": f64
  "X4": f64
  "X5": f64
panel indicators:
  "Average": f64
diagram:
  Add($X1, $X2, $X3, $X4, $X5) -> w1
  Divide(x=w1, y=5) -> w2
  $Average <- w2
