vi "Straight-Line Equation.gvi"   [Next Generation LabVIEW Features 1.0.0]
panel controls:
  "Slope (m)": f64
  "x": f64
  "Y-Intercept (b)": f64
panel indicators:
  "y": f64
diagram:
  Multiply($"Slope (m)", $x) -> w1
  Add(w1, $"Y-Intercept (b)") -> w2
  $y <- w2
