vi "Acquire Analyze Visualize - Part 2.gvi"   [Next Generation LabVIEW Features 1.0.0]
panel controls:
  "Maximum Threshold (deg C)": f64 = 30
panel indicators:
  "Current Temperature (deg C)": f64
  "Threshold Exceeded?": bool
  "Message": string
diagram:
  call "DAQmx Start Task.gvi"(task in="Thermocouple") -> (task out=w1)
  call "DAQmx Read (Analog DBL 1Chan 1Samp).gvi"(task in=w1) -> (task out=w2, data=w3)
  call "DAQmx Clear Task.gvi"(task in=w2)
  $"Current Temperature (deg C)" <- w3
  Is Greater(x=w3, y=$"Maximum Threshold (deg C)") -> w4  # Greater?
  $"Threshold Exceeded?" <- w4
  Select(s=w4, t="System in danger of overheating.\nTurn on the fan!", f="System is normal.") -> w5
  $Message <- w5
