vi "Acquire Analyze Visualize - Your Turn Solution.gvi"   [LabVIEW NXG 1.0.0]
panel indicators:
  "Current Temperature (deg C)": f64
  "Current Temperature (deg F)": f64
diagram:
  call "DAQmx Start Task.gvi"(task in="Thermocouple") -> (task out=w1)
  call "DAQmx Read (Analog DBL 1Chan 1Samp).gvi"(task in=w1) -> (task out=w2, data=w3)
  call "DAQmx Clear Task.gvi"(task in=w2)
  $"Current Temperature (deg C)" <- w3
  Multiply(w3, 9) -> w4
  Divide(x=w4, y=5) -> w5
  Add(w5, 32) -> w6
  $"Current Temperature (deg F)" <- w6
