vi "Full DAQmx API Method.gvi"   [LabVIEW NXG 1.0.0]
panel controls:
  "Desired Sample Rate (Hz)": f64 = 2560
  "PhysicalChannel": "Physical Channel" = "cDAQ1Mod7/ai0"
  "Input Terminal Configuration": i32 = "Default"(-1)
  "Number of Samples": i32 = 5120
  "Measurement Range": T1 = {"Maximum Value"=5, "Minimum Value"=-5}
panel indicators:
  "Actual Sample Rate (Hz)": f64
  "Data": waveform<f64>
types:
  T1 = cluster{"Maximum Value": f64, "Minimum Value": f64}
diagram:
  # DAQmx Create Channel
  call "DAQmx Create Channel (AI-Voltage-Basic).gvi"(physical channels=$PhysicalChannel, measurement range=$"Measurement Range", input terminal configuration=$"Input Terminal Configuration") -> (task out=w1)
  # DAQmx Timing
  call "DAQmx Timing (Sample Clock).gvi"(task in=w1, rate=$"Desired Sample Rate (Hz)", sample mode="Finite Samples"(10178), samples per channel=$"Number of Samples") -> (task out=w2)
  # Task Properties
  Property Node(instance in=w2) -> ("SampClk_Rate_1344"=w3, instance out=w4)
  # DAQmx Start Task
  call "DAQmx Start Task.gvi"(task in=w4) -> (task out=w5)
  # DAQmx Read
  call "DAQmx Read (Analog Wfm 1Chan NSamp).gvi"(task in=w5, number of samples per channel=$"Number of Samples") -> (task out=w6, data=w7)
  # DAQmx Clear
  call "DAQmx Clear Task.gvi"(task in=w6)
  $"Actual Sample Rate (Hz)" <- w3
  $Data <- w7
