vi "While Loop Basics with Tunnels.gvi"   [Next Generation LabVIEW Features 0.1.0]
panel controls:
  "Total Time in Seconds": f64
  "Stop": bool
panel indicators:
  "Seconds": f64
  "Minutes": f64
  "Hours": f64
  "Current Iteration": i32
  "Total Number of Iterations": i32
diagram:
  while (iteration -> i1) {
    Quotient And Remainder(x=$"Total Time in Seconds", y=3600) -> (floor(x/y)=w1, x-y*floor(x/y)=w2)
    Quotient And Remainder(x=w2, y=60) -> (floor(x/y)=w3, x-y*floor(x/y)=w4)
    $Seconds <- w4
    $Minutes <- w3
    $Hours <- w1
    $"Current Iteration" <- i1
    stop if $Stop
  }
  Increment(x=i1) -> w5
  $"Total Number of Iterations" <- w5
