vi "CPU Usage of Loop.gvi"   [LabVIEW NXG 1.0.0]
panel controls:
  "stop": bool
  "Slope (m)": f64
  "x": f64
  "Y-Intercept (b)": f64
panel indicators:
  "y": f64
diagram:
  while {
    Wait(time to wait=100)  # Wait (Milliseconds)
    Multiply($"Slope (m)", $x) -> w1
    Add(w1, $"Y-Intercept (b)") -> w2
    $y <- w2
    stop if $stop
  }
