vi "Using Timestamp and Elapsed Timer Nodes.gvi"   [LabVIEW NXG 1.0.0]
panel controls:
  "Target Time (s)": f64 = 1
  "Slope (m)": f64
  "x": f64
  "Y-Intercept (b)": f64
panel indicators:
  "Current Time": timestamp
  "Elapsed Time (s)": f64
  "Target Time Has Elapsed": bool
  "y": f64
uses:
  NI::G Core::Timing::Elapsed Timer.gvi
diagram:
  while {
    Wait(time to wait=100)  # Wait (Milliseconds)
    Multiply($"Slope (m)", $x) -> w1
    Add(w1, $"Y-Intercept (b)") -> w2
    $y <- w2
    Get Current Time() -> (current time=w3)
    $"Current Time" <- w3
    call "Elapsed Timer.gvi"(target time=$"Target Time (s)", reset=FALSE) -> (elapsed time=w4, time has elapsed=w5)
    $"Elapsed Time (s)" <- w4
    $"Target Time Has Elapsed" <- w5
    stop if w5
  }
