vi "Threshold Exceeded.gvi"   [LabVIEW NXG 1.0.0]
panel controls:
  "Thermocouple Channel": "Physical Channel" = "cDAQ1Mod2/ai0"
  "Stop": bool
  "Max Threshold (deg C)": f64
panel indicators:
  "Temperature Chart": f64
  "Threshold Currently Exceeded?": bool
  "Threshold Ever Exceeded?": bool
types:
  T1 = cluster{"maximum value": f64, "minimum value": f64}
uses:
  NI::G Core::Error::Display Error.gvi
diagram:
  call "DAQmx Create Channel (AI-Temperature-Thermocouple).gvi"(physical channels=$"Thermocouple Channel", measurement range=T1 {"maximum value"=100, "minimum value"=0}, thermocouple type="J"(10072)) -> (error out=w1, task out=w2)
  call "DAQmx Timing (Sample Clock).gvi"(error in=w1, task in=w2, rate=10, sample mode="Continuous Samples"(10123)) -> (error out=w3, task out=w4)
  call "DAQmx Start Task.gvi"(error in=w3, task in=w4) -> (error out=w5, task out=w6)
  s1 = FALSE  # shift register
  while {
    call "DAQmx Read (Analog DBL 1Chan 1Samp).gvi"(error in=w5, task in=w6) -> (error out=w7, task out=w8, data=w9)
    Is Greater(x=w9, y=$"Max Threshold (deg C)") -> w10
    Logical Or(s1, w10) -> w11
    $"Threshold Ever Exceeded?" <- w11
    $"Threshold Currently Exceeded?" <- w10
    $"Temperature Chart" <- w9
    Logical Or(w7, $Stop) -> w12
    next s1 = w11
    stop if w12
  }
  call "DAQmx Clear Task.gvi"(error in=w7, task in=w8) -> (error out=w13)
  call "Display Error.gvi"(error in=w13)
