vi "Track the Maximum Temperature.gvi"   [LabVIEW NXG 1.0.0]
panel controls:
  "Thermocouple Channel": "Physical Channel" = "cDAQ1Mod2/ai0"
  "Stop": bool
panel indicators:
  "Temperature Chart": f64
  "Max Temperature Acquired (deg C)": f64
types:
  T1 = cluster{"maximum value": f64, "minimum value": f64}
uses:
  NI::G Core::Error::Display Error.gvi
diagram:
  call "DAQmx Create Channel (AI-Temperature-Thermocouple).gvi"(physical channels=$"Thermocouple Channel", measurement range=T1 {"maximum value"=100, "minimum value"=0}, thermocouple type="J"(10072)) -> (error out=w1, task out=w2)
  call "DAQmx Timing (Sample Clock).gvi"(error in=w1, task in=w2, rate=10, sample mode="Continuous Samples"(10123)) -> (error out=w3, task out=w4)
  call "DAQmx Start Task.gvi"(error in=w3, task in=w4) -> (error out=w5, task out=w6)
  w7 = f64 default  # Negative Infinity
  s1 = w7  # shift register
  while {
    call "DAQmx Read (Analog DBL 1Chan 1Samp).gvi"(error in=w5, task in=w6) -> (error out=w8, task out=w9, data=w10)
    Max And Min(x=s1, y=w10) -> (max(x,y)=w11: f64)
    $"Max Temperature Acquired (deg C)" <- w11
    $"Temperature Chart" <- w10
    Logical Or(w8, $Stop) -> w12
    next s1 = w11
    stop if w12
  }
  call "DAQmx Clear Task.gvi"(error in=w8, task in=w9) -> (error out=w13)
  call "Display Error.gvi"(error in=w13)
