vi "Running Average Using Stacked Shift Register.gvi"   [LabVIEW NXG 1.0.0]
panel controls:
  "Thermocouple Channel": "Physical Channel" = "cDAQ1Mod2/ai0"
  "Stop": bool
panel indicators:
  "Temperature Chart": f64
  "Average Temperature Chart": f64
types:
  T1 = cluster{"maximum value": f64, "minimum value": f64}
uses:
  NI::G Core::Error::Display Error.gvi
diagram:
  call "DAQmx Create Channel (AI-Temperature-Thermocouple).gvi"(physical channels=$"Thermocouple Channel", measurement range=T1 {"maximum value"=100, "minimum value"=0}, thermocouple type="J"(10072)) -> (error out=w1, task out=w2)
  call "DAQmx Timing (Sample Clock).gvi"(error in=w1, task in=w2, rate=10, sample mode="Continuous Samples"(10123)) -> (error out=w3, task out=w4)
  call "DAQmx Start Task.gvi"(error in=w3, task in=w4) -> (error out=w5, task out=w6)
  call "DAQmx Read (Analog DBL 1Chan 1Samp).gvi"(error in=w5, task in=w6) -> (error out=w7, task out=w8, data=w9)
  # Initialize all elements of the stacked shift register with the initial temperature measurement
  s1 = w9  # shift register
  s1.prev1 = w9  # shift register
  s1.prev2 = w9  # shift register
  s1.prev3 = w9  # shift register
  while {
    call "DAQmx Read (Analog DBL 1Chan 1Samp).gvi"(error in=w7, task in=w8) -> (error out=w10, task out=w11, data=w12)
    Add(s1, s1.prev1, s1.prev2, s1.prev3, w12) -> w13
    Divide(x=w13, y=5) -> w14
    $"Average Temperature Chart" <- w14
    $"Temperature Chart" <- w12
    Logical Or(w10, $Stop) -> w15
    next s1 = w14
    stop if w15
  }
  call "DAQmx Clear Task.gvi"(error in=w10, task in=w11) -> (error out=w16)
  call "Display Error.gvi"(error in=w16)
