vi "N-Channel 1-Sample (1D DBL).gvi"   [LabVIEW NXG 1.0.0]
panel controls:
  "Thermocouple Channels": "Physical Channel" = "cDAQ1Mod8/ai0:3"
  "Stop": bool
panel indicators:
  "1D Numeric Output": f64[]
  "Chart": T1
types:
  T1 = cluster{"Element 0": f64, "Element 1": f64, "Element 2": f64, "Element 3": f64}
  T2 = cluster{"maximum value": f64, "minimum value": f64}
uses:
  NI::G Core::Error::Display Error.gvi
diagram:
  w1 = 1  # Sample Rate (Hz)
  call "DAQmx Create Channel (AI-Temperature-Thermocouple).gvi"(physical channels=$"Thermocouple Channels", measurement range=T2 {"maximum value"=100, "minimum value"=0}, thermocouple type="J"(10072)) -> (error out=w2, task out=w3)
  call "DAQmx Timing (Sample Clock).gvi"(error in=w2, task in=w3, rate=w1, sample mode="Continuous Samples"(10123)) -> (error out=w4, task out=w5)
  call "DAQmx Start Task.gvi"(error in=w4, task in=w5) -> (error out=w6, task out=w7)
  while {
    call "DAQmx Read (Analog 1D DBL NChan 1Samp).gvi"(error in=w6, task in=w7) -> (error out=w8, task out=w9, data=w10)
    Array To Cluster[NumberOfClusterElements=4](array=w10) -> (cluster=w11)
    $Chart <- w11
    $"1D Numeric Output" <- w10
    Logical Or(w8, $Stop) -> w12
    stop if w12
  }
  call "DAQmx Clear Task.gvi"(error in=w8, task in=w9) -> (error out=w13)
  call "Display Error.gvi"(error in=w13)
