vi "[Part 1] Extract Data from N-Channel Array (1D Waveform).gvi"   [LabVIEW NXG 1.0.0]
panel controls:
  "Desired Sampling Rate (Hz)": f64 = 2560
  "PhysicalChannel": "Physical Channel" = "cDAQ1Mod7/ai0:2"
  "Stop": bool
  "Number of Samples": i32 = 256
  "Index": i32
panel indicators:
  "All Channels": waveform<f64>[]
  "Indexed Channel": waveform<f64>
  "Actual Sample Rate (Hz)": f64
types:
  T1 = cluster{"maximum value": f64, "minimum value": f64}
uses:
  NI::G Core::Error::Display Error.gvi
diagram:
  w1 = $"Number of Samples"
  call "DAQmx Create Channel (AI-Voltage-Basic).gvi"(physical channels=$PhysicalChannel, measurement range=T1 {"maximum value"=5, "minimum value"=-5}) -> (error out=w2, task out=w3)
  call "DAQmx Timing (Sample Clock).gvi"(error in=w2, task in=w3, rate=$"Desired Sampling Rate (Hz)", sample mode="Continuous Samples"(10123), samples per channel=w1) -> (error out=w4, task out=w5)
  Property Node(instance in=w5, error in=w4) -> ("SampClk_Rate_1344"=w6, error out=w7, instance out=w8)
  $"Actual Sample Rate (Hz)" <- w6
  call "DAQmx Start Task.gvi"(error in=w7, task in=w8) -> (error out=w9, task out=w10)
  while {
    call "DAQmx Read (Analog 1D Wfm NChan NSamp).gvi"(error in=w9, task in=w10, number of samples per channel=w1) -> (error out=w11, task out=w12, data=w13)
    $"All Channels" <- w13
    Array Index(array=w13) -> (out0[$Index]=w14)
    $"Indexed Channel" <- w14
    Logical Or(w11, $Stop) -> w15
    stop if w15
  }
  call "DAQmx Clear Task.gvi"(error in=w11, task in=w12) -> (error out=w16)
  call "Display Error.gvi"(error in=w16)
