vi "[Challenge] Process N-Channel Array.gvi"   [LabVIEW NXG 1.0.0]
panel controls:
  "Desired Sample Rate (Hz)": f64 = 2560
  "PhysicalChannel": "Physical Channel" = "cDAQ1Mod7/ai0:3"
  "Stop": bool
  "number of samples": i32 = 2560
panel indicators:
  "Acquired Channels": waveform<f64>[]
  "Power Spectrum": T1[]
  "Actual Sample Rate (Hz)": f64
types:
  T1 = cluster{"f0": f64, "df": f64, "magnitude": f64[]}
  T2 = cluster{"maximum value": f64, "minimum value": f64}
uses:
  NI::Analysis::Windows::Window (Wfms).gvi
  NI::Analysis::Measurement::Power Spectrum for N Chan.gvi
  NI::G Core::Error::Display Error.gvi
diagram:
  w1 = $"number of samples"
  call "DAQmx Create Channel (AI-Voltage-Basic).gvi"(physical channels=$PhysicalChannel, measurement range=T2 {"maximum value"=5, "minimum value"=-5}) -> (error out=w2, task out=w3)
  call "DAQmx Timing (Sample Clock).gvi"(error in=w2, task in=w3, rate=$"Desired Sample Rate (Hz)", sample mode="Continuous Samples"(10123), samples per channel=w1) -> (error out=w4, task out=w5)
  Property Node(instance in=w5, error in=w4) -> ("SampClk_Rate_1344"=w6, error out=w7, instance out=w8)
  $"Actual Sample Rate (Hz)" <- w6
  call "DAQmx Start Task.gvi"(error in=w7, task in=w8) -> (error out=w9, task out=w10)
  while {
    call "DAQmx Read (Analog 1D Wfm NChan NSamp).gvi"(error in=w9, task in=w10, number of samples per channel=w1) -> (error out=w11, task out=w12, data=w13)
    $"Acquired Channels" <- w13
    call "Window (Wfms).gvi"(signal=w13, window type="Hanning"(1)) -> (windowed signal=w14)
    call "Power Spectrum for N Chan.gvi"(signal=w14, dB on=TRUE) -> (power spectrum=w15)
    $"Power Spectrum" <- w15
    Logical Or(w11, $Stop) -> w16
    stop if w16
  }
  call "DAQmx Clear Task.gvi"(error in=w11, task in=w12) -> (error out=w17)
  call "Display Error.gvi"(error in=w17)
