vi "[Part 2] Process N-Channel Array.gvi"   [LabVIEW NXG 1.0.0]
panel controls:
  "Desired Sample Rate (Hz)": f64 = 2560
  "Physical Channels": "Physical Channel" = "cDAQ1Mod7/ai0:3"
  "Stop": bool
  "Number of Samples": i32 = 2560
  "Cutoff Frequency": f64 = 1
panel indicators:
  "Acquired Channels": waveform<f64>[]
  "Scaled Channels": waveform<f64>[]
  "Filtered Channels": waveform<f64>[]
  "RMS Values": f64[]
  "Actual Sample Rate (Hz)": f64
types:
  T1 = cluster{"maximum value": f64, "minimum value": f64}
uses:
  NI::Analysis::Filtering::Butterworth Lowpass Filter NChan (Waveform).gvi
  NI::Analysis::Statistics::RMS (DBL).gvi
  NI::G Core::Error::Display Error.gvi
diagram:
  w1 = $"Number of Samples"
  call "DAQmx Create Channel (AI-Voltage-Basic).gvi"(physical channels=$"Physical Channels", measurement range=T1 {"maximum value"=5, "minimum value"=-5}) -> (error out=w2, task out=w3)
  call "DAQmx Timing (Sample Clock).gvi"(error in=w2, task in=w3, rate=$"Desired Sample Rate (Hz)", sample mode="Continuous Samples"(10123), samples per channel=w1) -> (error out=w4, task out=w5)
  Property Node(instance in=w5, error in=w4) -> ("SampClk_Rate_1344"=w6, error out=w7, instance out=w8)
  $"Actual Sample Rate (Hz)" <- w6
  call "DAQmx Start Task.gvi"(error in=w7, task in=w8) -> (error out=w9, task out=w10)
  while {
    call "DAQmx Read (Analog 1D Wfm NChan NSamp).gvi"(error in=w9, task in=w10, number of samples per channel=w1) -> (error out=w11, task out=w12, data=w13)
    $"Acquired Channels" <- w13
    Waveform Multiply(w13, 100) -> w14  # Multiply (Waveform)
    $"Scaled Channels" <- w14
    call "Butterworth Lowpass Filter NChan (Waveform).gvi"(signal=w13, cutoff frequency=$"Cutoff Frequency") -> (filtered signal=w15)
    $"Filtered Channels" <- w15
    for {
      w16 = each element of w13
      # The input of this node is not compatible with 1D Waveform or 2D DBL data types
      call "RMS (DBL).gvi"(x=w16) -> (rms value=w18)
      append w18 to w17
    }
    $"RMS Values" <- w17
    Logical Or(w11, $Stop) -> w19
    stop if w19
  }
  call "DAQmx Clear Task.gvi"(error in=w11, task in=w12) -> (error out=w20)
  call "Display Error.gvi"(error in=w20)
