vi "Condition Based on Measurement Result.gvi"   [LabVIEW NXG 1.0.0]
panel controls:
  "Desired Sample Rate": f64 = 2560
  "Number of Samples": i32 = 256
  "Stop": bool  # Stop stops the acquisition. It is recommended to stop your VI through this stop button so the DAQmx task can be properly cleared.
  "Acceleration Threshold (g)": f64 = 4.9
  "Accelerometer Channel": "Physical Channel" = "cDAQ1Mod7/ai0"
  "Acceleration units": i32 = "g"(10186)
  "Measurement Range": T1 = {"maximum value"=5, "minimum value"=-5}
  "Sensitivity": T2 = {"sensitivity"=175, "sensitivity units"=12509}
panel indicators:
  "Current Acceleration": waveform<f64>
  "Last Exceeded Acceleration": waveform<f64>
  "Actual Sample Rate (Hz)": f64
types:
  T1 = cluster{"maximum value": f64, "minimum value": f64}
  T2 = cluster{"sensitivity": f64, "sensitivity units": i32}
uses:
  NI::G Core::Waveform::Waveform Min Max.gvi
  NI::G Core::Error::Display Error.gvi
diagram:
  w1 = $"Number of Samples"
  w2 = "Continuous Samples"(10123)  # Sample Mode
  call "DAQmx Create Channel (AI-Acceleration-Accelerometer).gvi"(physical channels=$"Accelerometer Channel", units=$"Acceleration units", measurement range=$"Measurement Range", sensitivity=$Sensitivity) -> (error out=w3, task out=w4)
  call "DAQmx Timing (Sample Clock).gvi"(error in=w3, task in=w4, rate=$"Desired Sample Rate", sample mode=w2, samples per channel=w1) -> (error out=w5, task out=w6)
  Property Node(instance in=w6, error in=w5) -> ("SampClk_Rate_1344"=w7, error out=w8, instance out=w9)
  $"Actual Sample Rate (Hz)" <- w7
  call "DAQmx Start Task.gvi"(error in=w8, task in=w9) -> (error out=w10, task out=w11)
  while {
    call "DAQmx Read (Analog Wfm 1Chan NSamp).gvi"(error in=w10, task in=w11, number of samples per channel=w1) -> (error out=w12, task out=w13, data=w14)
    $"Current Acceleration" <- w14
    Waveform Absolute Value(x=w14) -> w15  # Absolute Value (Waveform)
    call "Waveform Min Max.gvi"(waveform=w15) -> (Y max=w16)
    Is Greater(x=w16, y=$"Acceleration Threshold (g)") -> w17  # Greater?
    case (w17) {
      frame False, Default { }
      frame True {
        $"Last Exceeded Acceleration" <- w14
      }
    }
    Logical Or(w12, $Stop) -> w18
    stop if w18
  }
  call "DAQmx Stop Task.gvi"(error in=w12, task in=w13) -> (error out=w19, task out=w20)
  call "DAQmx Clear Task.gvi"(error in=w19, task in=w20) -> (error out=w21)
  call "Display Error.gvi"(error in=w21)
