vi "Condition Based on User Input (Triggering).gvi"   [LabVIEW NXG 1.0.0]
# This example demonstrates how to acquire a single buffer of voltage measurements using a DAQmx device.
# For instructions on how to connect your signals to the DAQ device, refer to your device documentation.
panel controls:
  "Desired Sample Rate (Hz)": f64 = 1000  # Sample Rate specifies the sampling rate in samples per channel per second. If you use an external source for the Sample Clock, set this input to the maximum expected rate of that clock.
  "Number of Samples": i32 = 100  # Number of Samples specifies the number of samples to read.
  "Triggering Enabled?": bool
  "Physical Channel": "Physical Channel"
  "Digital Trigger Source": "Terminal"
  "Edge": i32 = "Rising"(10280)
panel indicators:
  "Actual Sample Rate (Hz)": f64
  "Graph": waveform<f64>[]
types:
  T1 = cluster{"maximum value": f64, "minimum value": f64}
uses:
  NI::G Core::Error::Display Error.gvi
diagram:
  w1 = "Finite Samples"(10178)  # Sample Mode
  call "DAQmx Create Channel (AI-Voltage-Basic).gvi"(physical channels=$"Physical Channel", measurement range=T1 {"maximum value"=5, "minimum value"=-5}) -> (error out=w2, task out=w3)
  call "DAQmx Timing (Sample Clock).gvi"(error in=w2, task in=w3, rate=$"Desired Sample Rate (Hz)", sample mode=w1, samples per channel=$"Number of Samples") -> (error out=w4, task out=w5)
  Property Node(instance in=w5, error in=w4) -> ("SampClk_Rate_1344"=w6, error out=w7, instance out=w8)
  case ($"Triggering Enabled?") {
    frame False {
      w9 = w8
      w10 = w7
    }
    frame True, Default {
      call "DAQmx Start Trigger (Digital Edge).gvi"(error in=w7, task in=w8, source=$"Digital Trigger Source", edge=$Edge) -> (error out=w10, task out=w9)
    }
  }
  call "DAQmx Start Task.gvi"(error in=w10, task in=w9) -> (error out=w11, task out=w12)
  call "DAQmx Read (Analog 1D Wfm NChan NSamp).gvi"(error in=w11, task in=w12) -> (error out=w13, task out=w14, data=w15)
  $Graph <- w15
  call "DAQmx Stop Task.gvi"(error in=w13, task in=w14) -> (error out=w16, task out=w17)
  call "DAQmx Clear Task.gvi"(error in=w16, task in=w17) -> (error out=w18)
  call "Display Error.gvi"(error in=w18)
  $"Actual Sample Rate (Hz)" <- w6
