vi "[Challenge] Condition Based on Measurement Result with Running Total.gvi"   [LabVIEW NXG 1.0.0]
panel controls:
  "Desired Sample Rate (Hz)": f64 = 2560
  "Number of Samples": i32 = 256
  "Stop": bool  # Stop stops the acquisition. It is recommended to stop your VI through this stop button so the DAQmx task can be properly cleared.
  "Acceleration Threshold (g)": f64 = 4.9
  "Accelerometer Channel": "Physical Channel" = "cDAQ1Mod7/ai0"
  "Acceleration units": i32 = "g"(10186)
  "Measurement Range": T1 = {"maximum value"=5, "minimum value"=-5}
  "Sensitivity": T2 = {"sensitivity"=175, "sensitivity units"=12509}
panel indicators:
  "Current Acceleration": waveform<f64>
  "Last Exceeded Acceleration": waveform<f64>
  "Number of Times Exceeded": u32
  "Actual Sample Rate (Hz)": f64
types:
  T1 = cluster{"maximum value": f64, "minimum value": f64}
  T2 = cluster{"sensitivity": f64, "sensitivity units": i32}
uses:
  NI::G Core::Waveform::Waveform Min Max.gvi
  NI::G Core::Error::Display Error.gvi
diagram:
  w1 = $"Number of Samples"
  w2 = "Continuous Samples"(10123)  # Sample Mode
  call "DAQmx Create Channel (AI-Acceleration-Accelerometer).gvi"(physical channels=$"Accelerometer Channel", units=$"Acceleration units", measurement range=$"Measurement Range", sensitivity=$Sensitivity) -> (error out=w3, task out=w4)
  call "DAQmx Timing (Sample Clock).gvi"(error in=w3, task in=w4, rate=$"Desired Sample Rate (Hz)", sample mode=w2, samples per channel=w1) -> (error out=w5, task out=w6)
  Property Node(instance in=w6, error in=w5) -> ("SampClk_Rate_1344"=w7, error out=w8, instance out=w9)
  call "DAQmx Start Task.gvi"(error in=w8, task in=w9) -> (error out=w10, task out=w11)
  w12 = 0  # # of times exceeded
  s1 = w12  # shift register
  while {
    call "DAQmx Read (Analog Wfm 1Chan NSamp).gvi"(error in=w10, task in=w11, number of samples per channel=w1) -> (error out=w13, task out=w14, data=w15)
    $"Current Acceleration" <- w15
    Waveform Absolute Value(x=w15) -> w16  # Absolute Value (Waveform)
    call "Waveform Min Max.gvi"(waveform=w16) -> (Y max=w17)
    Is Greater(x=w17, y=$"Acceleration Threshold (g)") -> w18  # Greater?
    case (w18) {
      frame False, Default {
        w19 = s1
      }
      frame True {
        Increment(x=s1) -> w19
        $"Last Exceeded Acceleration" <- w15
      }
    }
    $"Number of Times Exceeded" <- w19
    Logical Or(w13, $Stop) -> w20
    next s1 = w19
    stop if w20
  }
  call "DAQmx Stop Task.gvi"(error in=w13, task in=w14) -> (error out=w21, task out=w22)
  call "DAQmx Clear Task.gvi"(error in=w21, task in=w22) -> (error out=w23)
  call "Display Error.gvi"(error in=w23)
  $"Actual Sample Rate (Hz)" <- w7
